# Dynamo graph Dictionary.dyn (Dynamo 1.3.4.6666)

# group: Initiate Dictionary
code_block = CodeBlock { "a".."h"; 1..8; }
byKeysValues = Orchid.Common.Dictionary.ByKeysValues(code_block.out0, code_block.out1)

values = Orchid.Common.Dictionary.Values(byKeysValues)
watch = Watch(values)
keys = Orchid.Common.Dictionary.Keys(byKeysValues)
watch_2 = Watch(keys)
code_block_2 = CodeBlock { "a"; }
valueAtKey = Orchid.Common.Dictionary.ValueAtKey(byKeysValues, code_block_2)
await_ = Orchid.Common.DataStream.Await(byKeysValues, valueAtKey)
code_block_3 = CodeBlock { "a".."h"; 9..16; }
setValueAtKeys = Orchid.Common.Dictionary.SetValueAtKeys(await_, code_block_3.out0, code_block_3.out1)
components = Orchid.Common.Dictionary.Components(setValueAtKeys)
watch_3 = Watch(components.out0)
watch_4 = Watch(components.out1)
watch_5 = Watch(valueAtKey)
count = Orchid.Common.Dictionary.Count(byKeysValues)
watch_6 = Watch(count)
code_block_4 = CodeBlock { "a"; }
removeKeys = Orchid.Common.Dictionary.RemoveKeys(setValueAtKeys, code_block_4)
components_2 = Orchid.Common.Dictionary.Components(removeKeys)
watch_7 = Watch(components_2.out0)
watch_8 = Watch(components_2.out1)
