# Dynamo graph File+Fam-LoadFamily.dyn (Dynamo 1.3.4.6666)

# group: Open all files in directory and sub directories
string = StringInput(".\testSet")
code_block = CodeBlock { "*.rvt"; }
boolean = BoolSelector(false)
contents = Orchid.Core.Directory.Contents(string, code_block, boolean)

# group: Open all files in directory and sub directories
string_2 = StringInput(".\testSet")
code_block_2 = CodeBlock { "*.rfa"; }
boolean_2 = BoolSelector(false)
contents_2 = Orchid.Core.Directory.Contents(string_2, code_block_2, boolean_2)

loadFamily = Orchid.Core.File.LoadFamily(contents, contents_2)  # frozen
watch = Watch(loadFamily)
loadFamily_2 = Orchid.Core.File.LoadFamily(contents_2)
watch_2 = Watch(loadFamily_2)

# group: Open all files in directory and sub directories
string_3 = StringInput(".\testSet")
code_block_3 = CodeBlock { "*.rfa"; }
boolean_3 = BoolSelector(false)
contents_3 = Orchid.Core.Directory.Contents(string_3, code_block_3, boolean_3)  # frozen
backgroundOpen = Orchid.RevitProject.Document.BackgroundOpen(contents_3)

loadFamily_3 = Orchid.RevitFamily.Document.LoadFamily(backgroundOpen)
watch_3 = Watch(loadFamily_3)
await_ = Orchid.Core.DataStream.Await(backgroundOpen, loadFamily_3)

# group: Close files
close = Orchid.RevitProject.Document.Close(await_)
