# Dynamo graph Intersect.dyn (Dynamo 1.3.4.6666)

built_in_categories = CodeBlock()
# ---------- built_in_categories.designscript (26 lines) ----------
{
"OST_Casework",
"OST_Ceilings",
"OST_Columns",
"OST_CurtainWallMullions",
"OST_CurtainWallPanels",
"OST_CurtaSystem",
"OST_Doors",
"OST_Entourage",
"OST_Floors",
"OST_Furniture",
"OST_FurnitureSystems",
"OST_GenericModel",
"OST_PlumbingFixtures",
"OST_Ramps",
"OST_Roofs",
"OST_SpecialityEquipment",
"OST_Stairs",
"OST_StructuralColumns",
"OST_StructuralFoundation",
"OST_StructuralFraming",
"OST_StructuralFramingSystem",
"OST_StructuralStiffener",
"OST_Walls",
"OST_Windows"
};
# ----------------------------------------
natural_category_name = CodeBlock()
# ---------- natural_category_name.designscript (26 lines) ----------
{
"Casework",
"Ceilings",
"Columns",
"Curtain Wall Mullions",
"Curtain Panels",
"Curtain Systems",
"Doors",
"Entourage",
"Floors",
"Furniture",
"Furniture Systems",
"Generic Models",
"Plumbing Fixtures",
"Ramps",
"Roofs",
"Specialty Equipment",
"Stairs",
"Structural Columns",
"Structural Foundations",
"Structural Framing",
"Structural Beam Systems",
"Structural Stiffeners",
"Walls",
"Windows"
};
# ----------------------------------------

# group: Selection
elementByCategory = Orchid.RevitProject.Elements.Selection.ElementByCategory(arg1=natural_category_name)
watch = Watch(elementByCategory.out0)
intersect = Orchid.RevitProject.Elements.Element.Intersect(elementByCategory.out0)
watch_2 = Watch(intersect)
watch_3 = Watch(elementByCategory.out1)

# group: Selection
elementHasMaterial = Orchid.RevitProject.Elements.Selection.ElementHasMaterial()
intersect_2 = Orchid.RevitProject.Elements.Element.Intersect(elementHasMaterial.out0)
watch_4 = Watch(intersect_2)
watch_5 = Watch(elementHasMaterial.out0)
watch_6 = Watch(elementHasMaterial.out1)

# note: OOTB nodes
byName = Category.ByName(natural_category_name)
all_elements_of_category = ElementsOfCategory(byName)
clean = Orchid.Common.List.Clean(all_elements_of_category)
watch_7 = Watch(clean)
intersect_3 = Orchid.RevitProject.Elements.Element.Intersect(clean)
watch_8 = Watch(intersect_3)

# group: Sorting by boolean
flatten = Flatten(elementHasMaterial.out0)
hasIntersect = Orchid.RevitProject.Elements.Element.HasIntersect(elementHasMaterial.out0)
anyTrue = Orchid.Common.List.AnyTrue(hasIntersect@L2)
filterByBoolMask = List.FilterByBoolMask(list=flatten, mask=anyTrue)
intersect_4 = Orchid.RevitProject.Elements.Element.Intersect(filterByBoolMask.in)
watch_9 = Watch(intersect_4)
watch_10 = Watch(filterByBoolMask.in)
watch_11 = Watch(flatten)
watch_12 = Watch(anyTrue)

# group: Selection by category
code_block = CodeBlock { "Structural Framing"; {"Doors", "Walls"}; }
byName_2 = Category.ByName(code_block.out0)
all_elements_of_category_2 = ElementsOfCategory(byName_2)
byName_3 = Category.ByName(code_block.out1)
intersect_5 = Orchid.RevitProject.Elements.Element.Intersect(all_elements_of_category_2, byName_3)
watch_13 = Watch(intersect_5)
watch_14 = Watch(all_elements_of_category_2)
