# Dynamo graph AddConvert.dyn (Dynamo 1.3.4.6666)

# group: create family type
current = Orchid.RevitProject.Document.Current()
create = Orchid.RevitFamily.FamilyType.Create(current)

# group: Add shared parameter
await_ = Orchid.Core.DataStream.Await(current, create)
code_block = CodeBlock()
# ---------- code_block.designscript (16 lines) ----------
//Parameter name
{"Creator Name",
"Creator Organization",
"Creator Build"};
//SP Parameter group
"01:   Sheet & Project";
//SP Parameter type
"Text";
//Parameter group
"PG_ADSK_MODEL_PROPERTIES";
//Tooltip
"Creator value";
//Instances
true;
//Reporting
false;
# ----------------------------------------
# note: Please notice that I use a tab in my "SP Parameter group" names. This is not standard!
# "Sheet & Project" would be the normal way!
addSharedParameter = Orchid.RevitFamily.Parameter.AddSharedParameter(await_, code_block.out0, code_block.out1, code_block.out2, code_block.out3, code_block.out4, code_block.out5)

# group: Set formula
await_2 = Orchid.Core.DataStream.Await(current, addSharedParameter)
code_block_2 = CodeBlock()
# ---------- code_block_2.designscript (8 lines) ----------
//Parameter name
{"Creator Name",
"Creator Organization",
"Creator Build"};
//Values
{"\"Erik Falck Jørgensen\"",
"\"Danish Educational Content\"",
"\"2017.0418.0\""};
# ----------------------------------------
set = Orchid.RevitFamily.Formula.Set(await_2, code_block_2.out0, code_block_2.out1)

# group: Get Formula
await_3 = Orchid.Core.DataStream.Await(await_2, set)
code_block_3 = CodeBlock()
# ---------- code_block_3.designscript (4 lines) ----------
//Parameter name
{"Creator Name",
"Creator Organization",
"Creator Build"};
# ----------------------------------------
get = Orchid.RevitFamily.Formula.Get(await_3, code_block_3)

watch = Watch(get)

# group: Convert parameter
name = Orchid.RevitFamily.Parameter.Name(addSharedParameter)
code_block_4 = CodeBlock()
# ---------- code_block_4.designscript (2 lines) ----------
//Instances
true;
# ----------------------------------------
convert = Orchid.RevitFamily.Parameter.Convert(await_, name, code_block_4)

name_2 = Orchid.RevitFamily.Parameter.Name(convert)
watch_2 = Watch(name_2)

# group: Remove formula
await_4 = Orchid.Core.DataStream.Await(await_3, get)
code_block_5 = CodeBlock()  # same code as code_block_3
remove = Orchid.RevitFamily.Formula.Remove(await_4, code_block_5)

# group: Remove parameter value
await_5 = Orchid.Core.DataStream.Await(await_4, remove)
code_block_6 = CodeBlock()
# ---------- code_block_6.designscript (6 lines) ----------
//Parameter name
{"Creator Name",
"Creator Organization",
"Creator Build"};
//value
{"","",""};
# ----------------------------------------
setValue = Orchid.RevitFamily.Parameter.SetValue(await_5, arg2=code_block_6.out0, arg3=code_block_6.out1)

# group: Create shared parameter
await_6 = Orchid.Core.DataStream.Await(current, create)
code_block_7 = CodeBlock()
# ---------- code_block_7.designscript (8 lines) ----------
//Parameter name
"Dynamo test parameter";
//SP Parameter group
"Dynamo test group";
//SP Parameter type
"Text";
//Parameter group
"PG_ADSK_MODEL_PROPERTIES";
# ----------------------------------------
# note: Please notice that I use a tab in my "SP Parameter group" names. This is not standard!
# "Sheet & Project" would be the normal way!
createSharedParameter = Orchid.RevitFamily.Parameter.CreateSharedParameter(await_6, code_block_7.out0, code_block_7.out1, code_block_7.out2, code_block_7.out3)  # frozen

# group: Add shared parameter
await_7 = Orchid.Core.DataStream.Await(current, create)
code_block_8 = CodeBlock()
# ---------- code_block_8.designscript (8 lines) ----------
//Parameter name
{"test1","test2"};
//SP Parameter group
"01:   Sheet & Project";
//SP Parameter type
"Text";
//Parameter group
"PG_ADSK_MODEL_PROPERTIES";
# ----------------------------------------
# note: Please notice that I use a tab in my "SP Parameter group" names. This is not standard!
# "Sheet & Project" would be the normal way!
addSharedParameter_2 = Orchid.RevitFamily.Parameter.AddSharedParameter(await_7, code_block_8.out0, code_block_8.out1, code_block_8.out2, code_block_8.out3)  # frozen
