# Dynamo graph Collect families in project.dyn (Dynamo 1.3.4.6666)

# group: Open all files in directory and sub directories
string = StringInput("..\testSet")
code_block = CodeBlock { "*.rfa"; true; }
contents = Orchid.Common.Directory.Contents(string, code_block.out0)  # frozen
backgroundOpen = Orchid.RevitProject.Common.Document.BackgroundOpen(contents)

# group: Close files
await_ = Orchid.Common.DataStream.Await()  # unwired: arg0, arg1
boolean = BoolSelector(true)
close = Orchid.RevitProject.Common.Document.Close(await_, boolean)  # frozen

# group: Collect family as document from current document
code_block_2 = CodeBlock { {"Doors","Windows"}; }
elementByCategory = Orchid.RevitProject.Elements.Selection.ElementByCategory(arg1=code_block_2)
elementType = Element.ElementType(elementByCategory)
uniqueItems = List.UniqueItems(elementType, lacing=Longest)
flatten = Flatten(uniqueItems)
family = FamilyType.Family(flatten)

uniqueItems_2 = List.UniqueItems(family)

# group (continued): Collect family as document from current document
edit = Orchid.RevitProject.Elements.Family.Edit(uniqueItems_2)

code_block_3 = CodeBlock()
# ---------- code_block_3.designscript (12 lines) ----------
//Parameter name
"Creator Build";
//SP Parameter group
"Sheet & Project";
//SP Parameter type
"Text";
//Parameter group
"PG_ADSK_MODEL_PROPERTIES";
//Instances
true;
//Reporting
false;
# ----------------------------------------
add = Orchid.RevitFamily.SharedParameter.Add(edit, code_block_3.out0, code_block_3.out1, code_block_3.out2, code_block_3.out3, arg6=code_block_3.out4)

# group: load back into the current project
await_2 = Orchid.Common.DataStream.Await(edit, add)
load = Orchid.RevitProject.Elements.Family.Load(await_2)
await_3 = Orchid.Common.DataStream.Await(await_2, load)
close_2 = Orchid.RevitProject.Common.Document.Close(await_3)
