# Dynamo graph FamilyType.dyn (Dynamo 1.3.4.6666)

current = Orchid.RevitProject.Common.Document.Current()

# group: Add parameter
code_block = CodeBlock()
# ---------- code_block.designscript (13 lines) ----------
//Parameter name
{"Test","something"};
//Parameter type
"Text";
//"Length";
//Parameter group
"PG_ADSK_MODEL_PROPERTIES";
//Tooltip
"Owner value";
//Instances
false;
//Reporting
true;
# ----------------------------------------
addParameter = Orchid.RevitFamily.Parameter.AddParameter(current, code_block.out0, code_block.out1, code_block.out2)

# group: Rename parameter
await_ = Orchid.Core.DataStream.Await(current, addParameter)
code_block_2 = CodeBlock()
# ---------- code_block_2.designscript (4 lines) ----------
//Source name
"Test";
//Target name
"NewTest";
# ----------------------------------------
rename = Orchid.RevitFamily.Parameter.Rename(await_, code_block_2.out0, code_block_2.out1)

# group: Delete parameter
await_2 = Orchid.Core.DataStream.Await(await_, rename)
code_block_3 = CodeBlock()
# ---------- code_block_3.designscript (2 lines) ----------
//Parameter name
"NewTest";
# ----------------------------------------
delete = Orchid.RevitFamily.Parameter.Delete(await_2, code_block_3)

# group: Create type
code_block_4 = CodeBlock()
# ---------- code_block_4.designscript (2 lines) ----------
//Types to create
{"Type 1", "Type 2"};
# ----------------------------------------
create = Orchid.RevitFamily.FamilyType.Create(current, code_block_4)

# group: Rename type
await_3 = Orchid.Core.DataStream.Await(current, create)
code_block_5 = CodeBlock()
# ---------- code_block_5.designscript (4 lines) ----------
//Source name
"Type 1";
//Target name
"Type 3";
# ----------------------------------------
rename_2 = Orchid.RevitFamily.FamilyType.Rename(await_3, code_block_5.out0, code_block_5.out1)

# group: Delete type
await_4 = Orchid.Core.DataStream.Await(await_3, rename_2)
code_block_6 = CodeBlock()
# ---------- code_block_6.designscript (2 lines) ----------
//Type name
"Type 3";
# ----------------------------------------
byName = Orchid.RevitFamily.FamilyType.ByName(await_4, code_block_6)
delete_2 = Orchid.RevitFamily.FamilyType.Delete(await_4, byName)

# group: Get all family type
# note: This node is being processed among the first, while it always look at the current document and don't need a document to be loaded. Therefore, run the graph twice if you greate/delete types in the graph! This node is best to use in families where types are not added!
all = Orchid.RevitFamily.FamilyType.All()
name = Orchid.RevitFamily.FamilyType.Name(all)
watch = Watch(name)
watch_2 = Watch(all)

# group: Get all family type by document
await_5 = Orchid.Core.DataStream.Await(current, create)
all_2 = Orchid.RevitFamily.FamilyType.All(await_5)
name_2 = Orchid.RevitFamily.FamilyType.Name(all_2)
watch_3 = Watch(name_2)
watch_4 = Watch(all_2)

# group: Current family type by document
current_2 = Orchid.RevitFamily.FamilyType.Current(await_5)
name_3 = Orchid.RevitFamily.FamilyType.Name(current_2)
watch_5 = Watch(name_3)

# group: Current family type
# note: This node is being processed among the first, while it always look at the current document and don't need a document to be loaded. Therefore, run the graph twice if you greate/delete types in the graph! This node is best to use in families where types are not added!
current_3 = Orchid.RevitFamily.FamilyType.Current()
name_4 = Orchid.RevitFamily.FamilyType.Name(current_3)
watch_6 = Watch(name_4)
