# Dynamo graph Graphics.dyn (Dynamo 1.3.4.6666)

# group: Create, Set Render Appearance, SetShadingColor, Set Transparency, Set Surface Pattern, Set Surface Pattern Color, Set Cut Pattern, Set Cut Pattern Color --> For Revit 2019
code_block = CodeBlock { "_test3"; }
create = Orchid.RevitMaterial.Material.Create(code_block)
fill_patterns = FillPatterns("Diagonal crosshatch 3.0mm")
setSurfaceForegroundPattern = Orchid.RevitMaterial.Graphics.SetSurfaceForegroundPattern(create, fill_patterns)
code_block_2 = CodeBlock { DSCore.Color.ByARGB(255,145,185,165); }
setSurfaceForegroundPatternColor = Orchid.RevitMaterial.Graphics.SetSurfaceForegroundPatternColor(setSurfaceForegroundPattern, code_block_2)
getCutForegroundPattern = Orchid.RevitMaterial.Graphics.GetCutForegroundPattern(setSurfaceForegroundPatternColor)
watch = Watch(getCutForegroundPattern)
name = Material.Name(create)
watch_2 = Watch(name)
code_block_3 = CodeBlock { DSCore.Color.ByARGB(255,25,60,30); }
setShadingColor = Orchid.RevitMaterial.Graphics.SetShadingColor(create, code_block_3)
getShadingColor = Orchid.RevitMaterial.Graphics.GetShadingColor(setShadingColor)
watch_3 = Watch(getShadingColor)
code_block_4 = CodeBlock { 75; }
setTransparency = Orchid.RevitMaterial.Graphics.SetTransparency(create, code_block_4)
getTransparency = Orchid.RevitMaterial.Graphics.GetTransparency(setTransparency)
watch_4 = Watch(getTransparency)
watch_5 = Watch(create)
setCutForegroundPattern = Orchid.RevitMaterial.Graphics.SetCutForegroundPattern(create, fill_patterns)
setCutForegroundPatternColor = Orchid.RevitMaterial.Graphics.SetCutForegroundPatternColor(setCutForegroundPattern, code_block_2)
getCutForegroundPatternColor = Orchid.RevitMaterial.Graphics.GetCutForegroundPatternColor(setCutForegroundPatternColor)
watch_6 = Watch(getCutForegroundPatternColor)
fill_patterns_2 = FillPatterns("Diagonal down 3.0mm")
setCutBackgroundPattern = Orchid.RevitMaterial.Graphics.SetCutBackgroundPattern(create, fill_patterns_2)
code_block_5 = CodeBlock { 55; 125; 85; }
byARGB = Color.ByARGB(r=code_block_5.out0, g=code_block_5.out1, b=code_block_5.out2)
setCutBackgroundPatternColor = Orchid.RevitMaterial.Graphics.SetCutBackgroundPatternColor(setCutBackgroundPattern, byARGB)
getCutBackgroundPatternColor = Orchid.RevitMaterial.Graphics.GetCutBackgroundPatternColor(setCutBackgroundPatternColor)
watch_7 = Watch(getCutBackgroundPatternColor)
setSurfaceBackgroundPattern = Orchid.RevitMaterial.Graphics.SetSurfaceBackgroundPattern(create, fill_patterns_2)
setSurfaceBackgroundPatternColor = Orchid.RevitMaterial.Graphics.SetSurfaceBackgroundPatternColor(setSurfaceBackgroundPattern, byARGB)
getCutBackgroundPattern = Orchid.RevitMaterial.Graphics.GetCutBackgroundPattern(setSurfaceBackgroundPatternColor)
watch_8 = Watch(getCutBackgroundPattern)
boolean = BoolSelector(false)
setRenderAppearance = Orchid.RevitMaterial.Graphics.SetRenderAppearance(create, boolean)
getRenderAppearance = Orchid.RevitMaterial.Graphics.GetRenderAppearance(setRenderAppearance)
watch_9 = Watch(getRenderAppearance)
watch_10 = Watch(setCutBackgroundPattern)
watch_11 = Watch(setSurfaceBackgroundPattern)
watch_12 = Watch(setSurfaceForegroundPattern)
watch_13 = Watch(setCutForegroundPattern)

# group: Create, Get --> For Revit 2019
code_block_6 = CodeBlock { "_test2"; }
create_2 = Orchid.RevitMaterial.Material.Create(code_block_6)
watch_14 = Watch(create_2)
boolean_2 = BoolSelector(false)
code_block_7 = CodeBlock { DSCore.Color.ByARGB(255,25,60,30); 50; }
fill_patterns_3 = FillPatterns("Earth")
code_block_8 = CodeBlock { 45; 85; 65; }
byARGB_2 = Color.ByARGB(r=code_block_8.out0, g=code_block_8.out1, b=code_block_8.out2)
set = Orchid.RevitMaterial.Graphics.Set(create_2, boolean_2, code_block_7.out0, code_block_7.out1, fill_patterns_3, byARGB_2, arg10=fill_patterns_3, arg11=byARGB_2)
get = Orchid.RevitMaterial.Graphics.Get(set)
watch_15 = Watch(get.out0)
watch_16 = Watch(get.out1)
watch_17 = Watch(get.out2)
watch_18 = Watch(get.out3)
watch_19 = Watch(get.out4)
watch_20 = Watch(get.out5)
name_2 = Material.Name(create_2)
watch_21 = Watch(name_2)
watch_22 = Watch(get.out6)
watch_23 = Watch(get.out9)
watch_24 = Watch(get.out10)
watch_25 = Watch(get.out8)
watch_26 = Watch(get.out7)

# group: Smoothness, Shininess
code_block_9 = CodeBlock { "_test1"; }
create_3 = Orchid.RevitMaterial.Material.Create(code_block_9)
code_block_10 = CodeBlock { 50; }
setSmoothness = Orchid.RevitMaterial.Graphics.SetSmoothness(create_3, code_block_10)
getSmoothness = Orchid.RevitMaterial.Graphics.GetSmoothness(setSmoothness)
watch_27 = Watch(getSmoothness)
setShininess = Orchid.RevitMaterial.Graphics.SetShininess(create_3, code_block_10)
getShininess = Orchid.RevitMaterial.Graphics.GetShininess(setShininess)
watch_28 = Watch(getShininess)
