# Dynamo graph Document.dyn (Dynamo 1.3.4.6666)

# group: Does document contain category?
code_block = CodeBlock()
# ---------- code_block.designscript (4 lines) ----------
// Categories to verify
{"Areas","Rooms","Spaces"};
"Levels";
"Stairs";
# ----------------------------------------
containCategory = Orchid.RevitProject.Common.Document.ContainCategory(code_block.out0)
watch = Watch(containCategory)
categories = Categories("MEPSpaces")

# group: Does document contain type?
code_block_2 = CodeBlock()
# ---------- code_block_2.designscript (4 lines) ----------
// Types to verify
{"Area","Room","Space"};
"Level";
"Stairs";
# ----------------------------------------
containType = Orchid.RevitProject.Common.Document.ContainType(code_block_2.out0)
watch_2 = Watch(containType)
element_types = ElementTypes("Space")
