# Dynamo graph Group.dyn (Dynamo 1.3.4.6666)

# group: Does document contain category?
code_block = CodeBlock()
# ---------- code_block.designscript (9 lines) ----------
"Model";
"Annotation";
"AnalyticalModel";
"Internal";

{"Model",
"Annotation",
"AnalyticalModel",
"Internal"};
# ----------------------------------------
elementByCategoryType = Orchid.RevitProject.Elements.Selection.ElementByCategoryType(arg1=code_block.out0)
watch = Watch(elementByCategoryType)
code_block_2 = CodeBlock { "test"; }
flatten = Flatten(elementByCategoryType)
create = Orchid.RevitProject.Elements.Group.Create(code_block_2, flatten)

# group: Group delete
code_block_3 = CodeBlock { "test"; }
delete = Orchid.RevitProject.Elements.Group.Delete(code_block_3)
groups = Groups("No groups available.")
delete_2 = Orchid.RevitProject.Elements.Group.Delete(groups)
getByName = Orchid.RevitProject.Elements.Group.GetByName(code_block_3)
delete_3 = Orchid.RevitProject.Elements.Group.Delete(getByName)

# group: Group ungroup
code_block_4 = CodeBlock { "test"; }
unGroup = Orchid.RevitProject.Elements.Group.UnGroup(code_block_4)
groups_2 = Groups("No groups available.")
unGroup_2 = Orchid.RevitProject.Elements.Group.UnGroup(groups_2)
getByName_2 = Orchid.RevitProject.Elements.Group.GetByName(code_block_4)
unGroup_3 = Orchid.RevitProject.Elements.Group.UnGroup(getByName_2)

# group: GroupType delete
code_block_5 = CodeBlock { "test"; }
delete_4 = Orchid.RevitProject.Elements.GroupType.Delete(code_block_5)
groupTypes = GroupTypes("No group types available.")
delete_5 = Orchid.RevitProject.Elements.GroupType.Delete(groupTypes)
