# Dynamo graph LinkedDocument-pin.dyn (Dynamo 1.3.4.6666)

string = StringInput(".\2018_defaultProject.rvt")
backgroundOpen = Orchid.RevitProject.Common.Document.BackgroundOpen(string)

# group: Link revit file
string_2 = StringInput(".\defaultBuilding_2018.rvt")
link_positioning = Positioning("Origin")
code_block = CodeBlock { 10000; }
byCoordinates = Point.ByCoordinates(y=code_block)
attachment_type = AttachmentType("Overlay")
boolean = BoolSelector(true)
linkRevitFile = Orchid.RevitProject.Common.Link.LinkRevitFile(backgroundOpen, string_2, link_positioning, arg4=byCoordinates, arg5=attachment_type, arg6=boolean)

watch = Watch(linkRevitFile.out0)
watch_2 = Watch(linkRevitFile.out1)
pin = Orchid.RevitProject.Elements.Element.Pin(backgroundOpen, linkRevitFile.out0)
await_ = Orchid.Core.DataStream.Await(backgroundOpen, pin)
name = Orchid.RevitProject.Common.Document.Name(backgroundOpen)
code_block_2 = CodeBlock(name=name) { name+"_copy.rvt"; true; }
saveAs = Orchid.RevitProject.Common.Document.SaveAs(await_, code_block_2.out0, code_block_2.out1)
close = Orchid.RevitProject.Common.Document.Close(saveAs)

# group: Pin
categories = Categories("Walls")
all_elements_of_category = ElementsOfCategory(categories)  # frozen
pin_2 = Orchid.RevitProject.Elements.Element.Pin(all_elements_of_category)
unPin = Orchid.RevitProject.Elements.Element.UnPin()  # unwired: arg0

# group: Pin
categories_2 = Categories("Walls")
all_elements_of_category_2 = ElementsOfCategory(categories_2)  # frozen
pin_3 = Orchid.RevitProject.Elements.Element.Pin(arg1=all_elements_of_category_2)
unPin_2 = Orchid.RevitProject.Elements.Element.UnPin()  # unwired: arg1
