# Dynamo graph LinkedDocument.dyn (Dynamo 1.3.4.6666)

string = StringInput("%userprofile%\Programming\Source\Testing\Data\2019_Data\")
string_2 = StringInput("2019_defaultProject")
code_block = CodeBlock(a=string, b=string_2) { a+b+".rvt"; }
fromPath = Orchid.Common.File.FromPath(code_block)

# group: Revit links
getRevitFile = Orchid.RevitProject.Common.Link.GetRevitFile()
reload = Orchid.RevitProject.Common.Link.Reload(getRevitFile)  # frozen
repath = Orchid.RevitProject.Common.Link.Repath(getRevitFile, fromPath)  # frozen
unload = Orchid.RevitProject.Common.Link.Unload(getRevitFile)  # frozen
watch = Watch(getRevitFile)
name = Element.Name(getRevitFile)
watch_2 = Watch(name)

# group: CAD links
getCadFile = Orchid.RevitProject.Common.Link.GetCadFile()
watch_3 = Watch(getCadFile)
name_2 = Element.Name(getCadFile)
watch_4 = Watch(name_2)
reload_2 = Orchid.RevitProject.Common.Link.Reload(getCadFile)
watch_5 = Watch(reload_2)

# group: Get all linked files
getFile = Orchid.RevitProject.Common.Link.GetFile()
watch_6 = Watch(getFile.out1)
watch_7 = Watch(getFile.out0)

# group: Dropdown selector
linked_files = LinkedFile("Standard")
watch_8 = Watch(linked_files)
linked_revit_files = LinkedRevit("defaultBuilding_2019.rvt")
watch_9 = Watch(linked_revit_files)
linked_cad_files = LinkedCad("Drawing1.dwg")
watch_10 = Watch(linked_cad_files)

# group: Convert to Revit link
select_model_element = DSModelElementSelection()  # frozen
watch_11 = Watch(select_model_element)
convertToLink = Orchid.RevitProject.Common.Link.ConvertToLink(arg1=select_model_element)
watch_12 = Watch(convertToLink)

# group: Convert to CAD link
select_model_element_2 = DSModelElementSelection()  # frozen
watch_13 = Watch(select_model_element_2)
convertToLink_2 = Orchid.RevitProject.Common.Link.ConvertToLink(arg1=select_model_element_2)
watch_14 = Watch(convertToLink_2)

# group: Link revit file
string_3 = StringInput(".\defaultBuilding_2019.rvt")
link_positioning = Positioning("Origin")
code_block_2 = CodeBlock { 10000; }
byCoordinates = Point.ByCoordinates(y=code_block_2)
attachment_type = AttachmentType("Overlay")
boolean = BoolSelector(true)
setRevitFile = Orchid.RevitProject.Common.Link.SetRevitFile(arg1=string_3, arg2=link_positioning, arg4=byCoordinates, arg5=attachment_type, arg6=boolean)
watch_15 = Watch(setRevitFile.out0)
watch_16 = Watch(setRevitFile.out1)

# group: Link cad file
string_4 = StringInput("..\Drawing1.dwg")
link_positioning_2 = Positioning("Center")
import_unit = Unit("Millimeter")
import_color_mode = ColorMode("BlackAndWhite")
code_block_3 = CodeBlock { -1000; }
byCoordinates_2 = Point.ByCoordinates(y=code_block_3)
model_views = ModelView("Level 1 (door)")
boolean_2 = BoolSelector(false)
setCadFile = Orchid.RevitProject.Common.Link.SetCadFile(arg1=string_4, arg2=link_positioning_2, arg3=import_unit, arg4=import_color_mode, arg5=byCoordinates_2, arg7=model_views, arg8=boolean_2)
watch_17 = Watch(setCadFile.out0)
watch_18 = Watch(setCadFile.out1)

# group: Link cad file
string_5 = StringInput("..\Drawing1.dwg")
code_block_4 = CodeBlock { -1000; }
byCoordinates_3 = Point.ByCoordinates(x=code_block_4, y=code_block_4)
model_views_2 = ModelView("Level 1 (door)")
boolean_3 = BoolSelector(true)

setCadFile_2 = Orchid.RevitProject.Common.Link.SetCadFile(arg1=string_5, arg2=byCoordinates_3, arg4=model_views_2, arg5=boolean_3)

# group (continued): Link cad file
watch_19 = Watch(setCadFile_2.out0)
watch_20 = Watch(setCadFile_2.out1)
