# Dynamo graph MoveToOrigin.dyn (Dynamo 1.3.4.6666)

# group: Select special elements
element_types = ElementTypes("MultistoryStairs")
all_elements_of_type = ElementsOfType(element_types)
allStackedWall = Orchid.RevitProject.Elements.Wall.AllStackedWall()
allModel = Orchid.RevitProject.Elements.Group.AllModel()
getSeparationLine = Orchid.RevitProject.Elements.SpatialElement.GetSeparationLine()
create = List.Create(all_elements_of_type, allStackedWall, allModel, getSeparationLine)

# group: Select elements
code_block = CodeBlock()
# ---------- code_block.designscript (5 lines) ----------
// Category type elements
{"Model",
"Annotation"};
"AnalyticalModel";
"Internal";
# ----------------------------------------
elementByCategoryType = Orchid.RevitProject.Elements.Selection.ElementByCategoryType(arg1=code_block.out0)

# group: join selection
join = List.Join(create, elementByCategoryType)
clean = Orchid.Core.List.Clean(join)
flatten = Flatten(clean)

# group: delete revisions
# note: If revisions is deleted, then remember to
# remove they are added to the "move" list
deleteAll = Orchid.RevitProject.Common.Revision.DeleteAll()
await_ = Orchid.Core.DataStream.Await(flatten, deleteAll)

# group: new origin -> as vector
select_model_element = DSModelElementSelection()
getLocation = Element.GetLocation(select_model_element)
reverse = Orchid.Core.Geometry.Point.Reverse(getLocation)

# group: Adjust view crop box
modelAll = Orchid.RevitProject.Views.View.ModelAll()
move = Orchid.RevitProject.Views.View.Move(modelAll, reverse)

# group: Adjust sectionsbox
code_block_2 = CodeBlock { "3D View"; }
byName = Orchid.RevitProject.Views.ViewType.ByName(code_block_2)
byType = Orchid.RevitProject.Views.View.ByType(byName)
moveSectionBox = Orchid.RevitProject.Views.View.MoveSectionBox(byType, reverse)

# group: Select additional elements that not can be grouped
allDetail = Orchid.RevitProject.Elements.Group.AllDetail()
ownerViewType = Orchid.RevitProject.Elements.Element.OwnerViewType(allDetail)
code_block_3 = CodeBlock(t=ownerViewType) { t != "Detail"? true : false; }
filterByBoolMask = List.FilterByBoolMask(list=allDetail, mask=code_block_3)
# note: If revisions is deleted, then remember
# to remove they are added to the list
all = Orchid.RevitProject.Common.RevisionCloud.All()

# group: Adjust model
code_block_4 = CodeBlock { "dummy"; }
create_2 = Orchid.RevitProject.Elements.Group.Create(code_block_4, flatten)
join_2 = List.Join(create_2, filterByBoolMask.in, all)
move_2 = Orchid.RevitProject.Elements.Element.Move(join_2, reverse)
await_2 = Orchid.Core.DataStream.Await(create_2, move_2)
getByGroup = Orchid.RevitProject.Elements.GroupType.GetByGroup(await_2)
unGroup = Orchid.RevitProject.Elements.Group.UnGroup(await_2)
await_3 = Orchid.Core.DataStream.Await(getByGroup, unGroup)
delete = Orchid.RevitProject.Elements.GroupType.Delete(await_3)
