# Dynamo graph Parameter.dyn (Dynamo 1.3.4.6666)

# group: Add project parameter
code_block = CodeBlock()
# ---------- code_block.designscript (14 lines) ----------
//Parameter name
{"test1","test2"};
//Parameter type
"Text";
//Parameter group
"PG_IDENTITY_DATA";
//Tooltip
"Some tooltip";
//Instances
true;
//Vary Between Groups
true;
//Category
{"Walls","Windows"};
# ----------------------------------------
byName = Category.ByName(code_block.out6)
add = Orchid.RevitProject.Parameters.ProjectParameter.Add(code_block.out0, code_block.out1, code_block.out2, code_block.out3, code_block.out4, code_block.out5, byName)

# group: Add shared parameter
code_block_2 = CodeBlock()
# ---------- code_block_2.designscript (17 lines) ----------
//Parameter name
{"Creator Name",
"Creator Organization",
"Creator Build"};
//{"Paper Size","Subject"};
//SP Parameter group
"Sheet & Project";
//SP Parameter type
"Text";
//Parameter group
"PG_ADSK_MODEL_PROPERTIES";
//Instances
true;
//Vary Between Groups
true;
//Category
"Doors";
# ----------------------------------------
byName_2 = Category.ByName(code_block_2.out6)
add_2 = Orchid.RevitProject.Parameters.SharedParameter.Add(code_block_2.out0, code_block_2.out1, code_block_2.out2, code_block_2.out3, arg6=byName_2)

# group: Change parameter and category binding in the project
code_block_3 = CodeBlock()
# ---------- code_block_3.designscript (8 lines) ----------
//Parameter name
"Creator Name";
//Instances
true;
//Category
{"Doors",
"Entourage",
"Floors"};
# ----------------------------------------
byName_3 = Category.ByName(code_block_3.out2)
changeCategory = Orchid.RevitProject.Parameters.Parameter.ChangeCategory(code_block_3.out0, arg2=byName_3)  # frozen

# group: Delete parameter
code_block_4 = CodeBlock()
# ---------- code_block_4.designscript (2 lines) ----------
{"Creator Build",
"test2"};
# ----------------------------------------
delete = Orchid.RevitProject.Parameters.Parameter.Delete(code_block_4)  # frozen

# group: Project parameters in document
projectParameters = Orchid.RevitProject.Common.Document.ProjectParameters()
name = Element.Name(projectParameters.out0)
watch = Watch(name)
watch_2 = Watch(projectParameters.out0)
watch_3 = Watch(projectParameters.out1)

# group: Global parameters in document
globalParameters = Orchid.RevitProject.Common.Document.GlobalParameters()
watch_4 = Watch(globalParameters.out0)
name_2 = Element.Name(globalParameters.out0)
watch_5 = Watch(name_2)
watch_6 = Watch(globalParameters.out1)

# group: Shared parameters in document
sharedParameters = Orchid.RevitProject.Common.Document.SharedParameters()
watch_7 = Watch(sharedParameters.out0)
name_3 = Element.Name(sharedParameters.out0)
watch_8 = Watch(name_3)
watch_9 = Watch(sharedParameters.out1)
watch_10 = Watch(sharedParameters.out2)

# group: clean for unwanted parameters
string = StringInput("ParameterCopy")
contains = String.Contains(str=name_3, searchFor=string)
filterByBoolMask = List.FilterByBoolMask(list=sharedParameters.out0, mask=contains)
delete_2 = Orchid.RevitProject.Elements.Element.Delete(filterByBoolMask.in)  # frozen
name_4 = Element.Name(filterByBoolMask.in)
watch_11 = Watch(name_4)
watch_12 = Watch(filterByBoolMask.in)

# group: Add basic IFC parameter
addIFC = Orchid.RevitProject.Parameters.ProjectParameter.AddIFC()  # frozen

# group: Associate --> global parameters
categories = Categories("Windows")  # frozen
all_elements_of_category = ElementsOfCategory(categories)
code_block_5 = CodeBlock { "test2"; }
associate = Orchid.RevitProject.Parameters.GlobalParameter.Associate(all_elements_of_category, code_block_5, globalParameters.out0, lacing=Longest)
await_ = Orchid.Common.DataStream.Await(all_elements_of_category, associate)
getAssociated = Orchid.RevitProject.Parameters.GlobalParameter.GetAssociated(await_, code_block_5)
watch_13 = Watch(getAssociated)
hasAssociated = Orchid.RevitProject.Parameters.GlobalParameter.HasAssociated(await_, code_block_5)
watch_14 = Watch(hasAssociated)

# group: Create shared parameter
code_block_6 = CodeBlock()
# ---------- code_block_6.designscript (16 lines) ----------
//Parameter name
"Dynamo test parameter";
//SP Parameter group
"Dynamo test group";
//SP Parameter type
"Text";
//Parameter group
"PG_ADSK_MODEL_PROPERTIES";
//Tooltip
"Some tooltip";
//Instances
true;
//Vary Between Groups
true;
//Category
"Doors";
# ----------------------------------------
byName_4 = Category.ByName(code_block_6.out7)
create = Orchid.RevitProject.Parameters.SharedParameter.Create(code_block_6.out0, code_block_6.out1, code_block_6.out2, code_block_6.out3, arg7=byName_4)  # frozen
add_3 = Orchid.RevitProject.Parameters.SharedParameter.Add(code_block_6.out0, code_block_6.out1, code_block_6.out2, code_block_6.out3, code_block_6.out5, code_block_6.out6, byName_4)  # frozen

# group: Parameter definition (external)
code_block_7 = CodeBlock()
# ---------- code_block_7.designscript (4 lines) ----------
//Parameter name
{"Creator Name",
"Creator Organization",
"Creator Build"};
# ----------------------------------------
getExternal = Orchid.RevitProject.Parameters.Definition.GetExternal(code_block_7)
watch_15 = Watch(getExternal)

# group: Parameter definition
byParameter = Orchid.RevitProject.Parameters.Definition.ByParameter(sharedParameters.out0)
watch_16 = Watch(byParameter)
byName_5 = Orchid.RevitProject.Parameters.Definition.ByName(name)
watch_17 = Watch(byName_5)
