# Dynamo graph Project.dyn (Dynamo 1.3.4.6666)

# group: Project phase
phases = Phase("New Construction")
watch = Watch(phases)

# group: Project location
project_origin = Origin("Internal")
setProjectLocation = Orchid.RevitProject.Project.SetProjectLocation(project_origin)
watch_2 = Watch(setProjectLocation)
getProjectLocation = Orchid.RevitProject.Project.GetProjectLocation()
watch_3 = Watch(getProjectLocation)
