# Dynamo graph Purge PostCommand.dyn (Dynamo 1.3.4.6666)

# group: orchid
boolean = BoolSelector(false)
purge = Orchid.RevitProject.Document.Purge(arg1=boolean)

# group: orchid
boolean_2 = BoolSelector(false)
purge_2 = Orchid.RevitProject.PostCommand.Purge(boolean_2)  # frozen
