# Dynamo graph ViewDuplicate-ViewTemplate.dyn (Dynamo 1.3.4.6666)

# group: Duplicate view
allLevels = Orchid.RevitProject.Common.Document.AllLevels()
byLevel = FloorPlanView.ByLevel(allLevels)
concat = String.Concat()  # unwired: arg0, arg1
code_block = CodeBlock()
# ---------- code_block.designscript (5 lines) ----------
// Text to add
{"DTUfm CHECK - ",
"DTUfm UPLOAD - ",
"EXPORT DWG - ",
"Color CHECK - "};
# ----------------------------------------
name = Element.Name(allLevels)
cartesianProduct = List.CartesianProduct(concat, code_block, name)
transpose = List.Transpose(cartesianProduct)
view_duplicate_options = ViewDuplicateOption("Duplicate")
duplicate = Orchid.RevitProject.Views.View.Duplicate(byLevel, transpose, view_duplicate_options)
transpose_2 = List.Transpose(duplicate)
await_ = Orchid.Common.DataStream.Await(byLevel, duplicate)
delete = Orchid.RevitProject.Elements.Element.Delete(await_)

# group: Find view template in model
all = Orchid.RevitProject.Views.ViewTemplate.All()
code_block_2 = CodeBlock()
# ---------- code_block_2.designscript (5 lines) ----------
// ViewTemplate to use
{"DTUfm - CHECK",
"DTUfm - UPLOAD",
"DTU Export DWG",
"DTU Color CHECK"};
# ----------------------------------------
name_2 = Element.Name(all)
containsItem = List.ContainsItem(list=code_block_2, item=name_2@L1)
filterByBoolMask = List.FilterByBoolMask(list=all, mask=containsItem)

# group: Set view template
name_3 = Element.Name(filterByBoolMask.in)
byKeysValues = Orchid.Common.Dictionary.ByKeysValues(name_3, filterByBoolMask.in)
valueAtKey = Orchid.Common.Dictionary.ValueAtKey(byKeysValues, code_block_2)
set = Orchid.RevitProject.Views.ViewTemplate.Set(transpose_2, valueAtKey)

watch = Watch(set)
