# Dynamo graph Nested-Lookup.dyn (Dynamo 1.3.3.4651)

# group: Load a family (nested)
string = StringInput(".\testSet\Front - Plain.rfa")
backgroundOpen = Orchid.Revit.Core.Document.BackgroundOpen(string)
loadFamily = Orchid.Revit.FamilyDocument.Document.LoadFamily(backgroundOpen)
close = Orchid.Revit.Core.Document.Close(loadFamily)

# group: create default family type
create = Orchid.Revit.FamilyDocument.FamilyType.Create()

# group: Create ordinary parameter
code_block = CodeBlock()
# ---------- code_block.designscript (6 lines) ----------
//Parameter name
{"Width","testValue"};
//Parameter type
"Length";
//Parameter group
"PG_ADSK_MODEL_PROPERTIES";
# ----------------------------------------
addParameter = Orchid.Revit.FamilyDocument.Parameter.AddParameter(create, code_block.out0, code_block.out1, code_block.out2)

# group: Create ordinary parameter
code_block_2 = CodeBlock()
# ---------- code_block_2.designscript (6 lines) ----------
//Parameter name
{"Lookup Table Name","testKey"};
//Parameter type
"Text";
//Parameter group
"PG_ADSK_MODEL_PROPERTIES";
# ----------------------------------------
addParameter_2 = Orchid.Revit.FamilyDocument.Parameter.AddParameter(addParameter, code_block_2.out0, code_block_2.out1, code_block_2.out2)

# group: Set parameter
code_block_3 = CodeBlock()
# ---------- code_block_3.designscript (4 lines) ----------
//Parameter name
{"Lookup Table Name","testKey"};
//Values
{"CSVLookuptable","11x300"};
# ----------------------------------------
setValue = Orchid.Revit.FamilyDocument.Parameter.SetValue(addParameter_2, arg2=code_block_3.out0, arg3=code_block_3.out1)

# group: Add lookup table and use it by setting a formula
string_2 = StringInput("size_lookup(Lookup Table Name, \"d\", 0, testKey)")
string_3 = StringInput(".\CSVLookuptable.csv")
addLookupTable = Orchid.Revit.FamilyDocument.Document.AddLookupTable(setValue, string_3)
code_block_4 = CodeBlock()
# ---------- code_block_4.designscript (4 lines) ----------
//Parameter name
"testValue";
//Values
{"size_lookup(Lookup Table Name, \"d\", 0, testKey)"};
# ----------------------------------------
setValue_2 = Orchid.Revit.FamilyDocument.Formula.SetValue(addLookupTable, code_block_4.out0, code_block_4.out1)

# group: Set parameter
code_block_5 = CodeBlock()
# ---------- code_block_5.designscript (4 lines) ----------
//Parameter name
"Width";
//Value
800.0;
# ----------------------------------------
setValue_3 = Orchid.Revit.FamilyDocument.Parameter.SetValue(addParameter, arg2=code_block_5.out0, arg3=code_block_5.out1)

# group: Associate parameter
code_block_6 = CodeBlock { "Front - Plain"; }
code_block_7 = CodeBlock(waitFor=loadFamily, pass=code_block_6) { {waitFor,pass}[1]; }
byName = FamilyType.ByName(code_block_7)
code_block_8 = CodeBlock()
# ---------- code_block_8.designscript (4 lines) ----------
//Parameter name
"Width";
//Parameter name
"Width";
# ----------------------------------------
associate = Orchid.Revit.FamilyDocument.Parameter.Associate(setValue_3, byName, code_block_8.out0, code_block_8.out1)

# group: Get nested families and Converters
getNested = Orchid.Revit.FamilyDocument.Family.GetNested(associate)
watch = Watch(getNested.out1)
toDynamoElement = Orchid.Revit.Core.Object.ToDynamoElement(getNested.out1)
watch_2 = Watch(toDynamoElement)
toAutodeskElement = Orchid.Revit.Core.Object.ToAutodeskElement(toDynamoElement)
watch_3 = Watch(toAutodeskElement)

# group: Get nested family types, converted to dynamo elements --> use OOTB nodes inside family document
getNested_2 = Orchid.Revit.FamilyDocument.FamilyType.GetNested(associate)
watch_4 = Watch(getNested_2.out1)
toDynamoElement_2 = Orchid.Revit.Core.Object.ToDynamoElement(getNested_2.out1)
watch_5 = Watch(toDynamoElement_2)
name = Element.Name(toDynamoElement_2)
watch_6 = Watch(name)
lastItem = List.LastItem(toDynamoElement_2)
code_block_9 = CodeBlock()
# ---------- code_block_9.designscript (2 lines) ----------
//Parameter name
{"Width"};
# ----------------------------------------
getParameterValueByName = Element.GetParameterValueByName(element=lastItem, parameterName=code_block_9)
watch_7 = Watch(getParameterValueByName)

# group: Create Family Type parameter (Category)
code_block_10 = CodeBlock()
# ---------- code_block_10.designscript (8 lines) ----------
//Parameter name
{"testFamily"};
//Parameter group
"PG_ADSK_MODEL_PROPERTIES";
//Instances
true;
//Reporting
false;
# ----------------------------------------
categories = Categories("Casework")
addParameter_3 = Orchid.Revit.FamilyDocument.Parameter.AddParameter(associate, code_block_10.out0, categories, code_block_10.out1)

# group: OOTB parameter nodes
select_builtin_parameter_group = BuiltInParameterGroup()
watch_8 = Watch(select_builtin_parameter_group)
select_parameter_type = ParameterType()
watch_9 = Watch(select_parameter_type)
