# Dynamo graph Material.dyn (Dynamo 1.3.4.6666)

# group: Create, Set Render Appearance, SetShadingColor, Set Transparency, Set Surface Pattern, Set Surface Pattern Color, Set Cut Pattern, Set Cut Pattern Color
code_block = CodeBlock { "_test1"; }
create = Orchid.Revit.Materials.Material.Create(code_block)
boolean = BoolSelector(false)
setRenderAppearance = Orchid.Revit.Materials.Graphics.SetRenderAppearance(create, boolean)
code_block_2 = CodeBlock { {25,60,30,0}; }
setShadingColor = Orchid.Revit.Materials.Graphics.SetShadingColor(setRenderAppearance, code_block_2)
code_block_3 = CodeBlock { 75; }
setTransparency = Orchid.Revit.Materials.Graphics.SetTransparency(setShadingColor, code_block_3)
fill_patterns = FillPatterns("100mm Horizontal")
setSurfacePattern = Orchid.Revit.Materials.Graphics.SetSurfacePattern(setTransparency, fill_patterns)
code_block_4 = CodeBlock { 145; 185; 165; }
byARGB = Color.ByARGB(r=code_block_4.out0, g=code_block_4.out1, b=code_block_4.out2)
setSurfacePatternColor = Orchid.Revit.Materials.Graphics.SetSurfacePatternColor(setSurfacePattern, byARGB)
setCutPattern = Orchid.Revit.Materials.Graphics.SetCutPattern(setSurfacePatternColor, fill_patterns)
watch = Watch(setCutPattern)
name = Material.Name(setCutPattern)
watch_2 = Watch(name)
getShadingColor = Orchid.Revit.Materials.Graphics.GetShadingColor(setShadingColor)
watch_3 = Watch(getShadingColor)
getTransparency = Orchid.Revit.Materials.Graphics.GetTransparency(setTransparency)
watch_4 = Watch(getTransparency)
getSurfacePattern = Orchid.Revit.Materials.Graphics.GetSurfacePattern(setSurfacePattern)
watch_5 = Watch(getSurfacePattern)
getCutPattern = Orchid.Revit.Materials.Graphics.GetCutPattern(setCutPattern)
watch_6 = Watch(getCutPattern)
setCutPatternColor = Orchid.Revit.Materials.Graphics.SetCutPatternColor(setCutPattern, byARGB)
getCutPatternColor = Orchid.Revit.Materials.Graphics.GetCutPatternColor(setCutPatternColor)
watch_7 = Watch(getCutPatternColor)
getSurfacePatternColor = Orchid.Revit.Materials.Graphics.GetSurfacePatternColor(setSurfacePatternColor)
watch_8 = Watch(getSurfacePatternColor)
getRenderAppearance = Orchid.Revit.Materials.Graphics.GetRenderAppearance(setRenderAppearance)
watch_9 = Watch(getRenderAppearance)

# group: Create, Get
code_block_5 = CodeBlock { "_test2"; }
create_2 = Orchid.Revit.Materials.Material.Create(code_block_5)
watch_10 = Watch(create_2)
boolean_2 = BoolSelector(false)
code_block_6 = CodeBlock { {25,60,30,0}; 50; }
fill_patterns_2 = FillPatterns("200mm Squares")
code_block_7 = CodeBlock { 45; 85; 65; }
byARGB_2 = Color.ByARGB(r=code_block_7.out0, g=code_block_7.out1, b=code_block_7.out2)
set = Orchid.Revit.Materials.Graphics.Set(create_2, boolean_2, code_block_6.out0, code_block_6.out1, fill_patterns_2, byARGB_2)
get = Orchid.Revit.Materials.Graphics.Get(set)
watch_11 = Watch(get.out0)
watch_12 = Watch(get.out1)
watch_13 = Watch(get.out2)
watch_14 = Watch(get.out3)
watch_15 = Watch(get.out4)
watch_16 = Watch(get.out5)
name_2 = Material.Name(create_2)
watch_17 = Watch(name_2)
watch_18 = Watch(get.out6)

# group: All
all = Orchid.Revit.Materials.Material.All()
name_3 = Material.Name(all)
watch_19 = Watch(name_3)
watch_20 = Watch(all)

# group: Class/Category
material = MaterialDD("Brick, Common")
getCategory = Orchid.Revit.Materials.Material.GetCategory(material)
watch_21 = Watch(getCategory)
getClass = Orchid.Revit.Materials.Material.GetClass(material)
watch_22 = Watch(getClass)

# group: Asset
material_2 = MaterialDD("Brick, Common")
asset = Orchid.Revit.Materials.Material.Asset(material_2)
watch_23 = Watch(asset.out0)
watch_24 = Watch(asset.out1)
watch_25 = Watch(asset.out2)

# group: Smoothness, Shininess
code_block_8 = CodeBlock { "_test3"; }
create_3 = Orchid.Revit.Materials.Material.Create(code_block_8)
code_block_9 = CodeBlock { 50; }
setSmoothness = Orchid.Revit.Materials.Graphics.SetSmoothness(create_3, code_block_9)
getSmoothness = Orchid.Revit.Materials.Graphics.GetSmoothness(setSmoothness)
watch_26 = Watch(getSmoothness)
setShininess = Orchid.Revit.Materials.Graphics.SetShininess(create_3, code_block_9)
getShininess = Orchid.Revit.Materials.Graphics.GetShininess(setShininess)
watch_27 = Watch(getShininess)

# group: Asset Parameter
material_3 = MaterialDD("Brick, Common")
assetParameter = Orchid.Revit.Materials.Material.AssetParameter(material_3)
watch_28 = Watch(assetParameter.out0)
watch_29 = Watch(assetParameter.out1)
watch_30 = Watch(assetParameter.out2)

# group: Parameter
material_4 = MaterialDD("Brick, Common")
parameter = Orchid.Revit.Materials.Material.Parameter(material_4)
watch_31 = Watch(parameter)
