# Dynamo graph Physical-Thermal.dyn (Dynamo 1.3.4.6666)

# group: Create material: Concrete (C30)
code_block = CodeBlock { "_Concrete"; }
create = Orchid.Revit.Materials.Material.Create(code_block)
material_aspect = MaterialAspectDD("Thermal")
thermal_type = ThermalTypeDD("Solid")
boolean = BoolSelector(true)
create_2 = Orchid.Revit.Materials.ThermalAsset.Create(code_block, thermal_type, boolean)
code_block_2 = CodeBlock()
# ---------- code_block_2.designscript (6 lines) ----------
"Concrete f'c=30 MPa";
"structural,concrete,CC:BS 8110";
"thermal,solid";
"Concrete";
"Orchid generated";
"https://github.com/erfajo/OrchidForDynamo";
# ----------------------------------------
setInformation = Orchid.Revit.Materials.ThermalAsset.SetInformation(create_2, code_block_2.out0, code_block_2.out2, code_block_2.out3, code_block_2.out4, code_block_2.out5)
boolean_2 = BoolSelector(false)
asset_behavior = AssetBehaviorDD("Isotropic")
code_block_3 = CodeBlock { 1.046; 0.657; 2300; 0.95; 182.4; 0.01; 0; 2000000; }
setProperties = Orchid.Revit.Materials.ThermalAsset.SetProperties(setInformation, boolean_2, asset_behavior, code_block_3.out0, code_block_3.out1, code_block_3.out2, code_block_3.out3, code_block_3.out4, code_block_3.out5, code_block_3.out6, code_block_3.out7)
setAsset = Orchid.Revit.Materials.Material.SetAsset(create, material_aspect, setProperties)
name = Material.Name(setAsset)
watch = Watch(name)
watch_2 = Watch(setAsset)
material_aspect_2 = MaterialAspectDD("Physical (Structural)")
physical_type = PhysicalTypeDD("Concrete")
create_3 = Orchid.Revit.Materials.PhysicalAsset.Create(code_block, physical_type, boolean)
setInformation_2 = Orchid.Revit.Materials.PhysicalAsset.SetInformation(create_3, code_block_2.out0, code_block_2.out1, code_block_2.out3, code_block_2.out4, code_block_2.out5)
asset_behavior_2 = AssetBehaviorDD("Isotropic")
setBehavior = Orchid.Revit.Materials.PhysicalAsset.SetBehavior(setInformation_2, asset_behavior_2)
code_block_4 = CodeBlock { 0.00001; }
setBasicThermal = Orchid.Revit.Materials.PhysicalAsset.SetBasicThermal(setBehavior, code_block_4)
code_block_5 = CodeBlock { 20500; 0.2; 11200; 2406.45; }
setMechanical = Orchid.Revit.Materials.PhysicalAsset.SetMechanical(setBasicThermal, code_block_5.out0, code_block_5.out1, code_block_5.out2, code_block_5.out3)
code_block_6 = CodeBlock { 30.0; 1.0; }
boolean_3 = BoolSelector(false)
setConcrete = Orchid.Revit.Materials.PhysicalAsset.SetConcrete(setMechanical, code_block_6.out0, code_block_6.out1, boolean_3)
setAsset_2 = Orchid.Revit.Materials.Material.SetAsset(create, material_aspect_2, setConcrete)
name_2 = Material.Name(setAsset_2)
watch_3 = Watch(name_2)
watch_4 = Watch(setAsset_2)

# group: Create material: Oxygen
code_block_7 = CodeBlock { "_Oxygen"; }
create_4 = Orchid.Revit.Materials.Material.Create(code_block_7)
material_aspect_3 = MaterialAspectDD("Thermal")
thermal_type_2 = ThermalTypeDD("Gas")
boolean_4 = BoolSelector(true)
create_5 = Orchid.Revit.Materials.ThermalAsset.Create(code_block_7, thermal_type_2, boolean_4)
code_block_8 = CodeBlock()
# ---------- code_block_8.designscript (6 lines) ----------
"Oxygen, properties at atmospheric pressure";
"structural,gas";
"thermal,gas";
"Gas";
"Orchid generated";
"https://github.com/erfajo/OrchidForDynamo";
# ----------------------------------------
setInformation_3 = Orchid.Revit.Materials.ThermalAsset.SetInformation(create_5, code_block_8.out0, code_block_8.out2, code_block_8.out3, code_block_8.out4, code_block_8.out5)
code_block_9 = CodeBlock { 0.0242; 0.9118; 1.35; 0.01; 0; 1; }
setBasicThermal_2 = Orchid.Revit.Materials.ThermalAsset.SetBasicThermal(setInformation_3, code_block_9.out0, code_block_9.out1, code_block_9.out2, code_block_9.out3, code_block_9.out4, code_block_9.out5)
setAsset_3 = Orchid.Revit.Materials.Material.SetAsset(create_4, material_aspect_3, setBasicThermal_2)
watch_5 = Watch(setAsset_3)
name_3 = Material.Name(setAsset_3)
watch_6 = Watch(name_3)
material_aspect_4 = MaterialAspectDD("Physical (Structural)")
physical_type_2 = PhysicalTypeDD("Gas")
create_6 = Orchid.Revit.Materials.PhysicalAsset.Create(code_block_7, physical_type_2, boolean_4)
setInformation_4 = Orchid.Revit.Materials.PhysicalAsset.SetInformation(create_6, code_block_8.out0, code_block_8.out1, code_block_8.out3, code_block_8.out4, code_block_8.out5)
code_block_10 = CodeBlock { 500; }
setBasicThermal_3 = Orchid.Revit.Materials.PhysicalAsset.SetBasicThermal(setInformation_4, code_block_10)
code_block_11 = CodeBlock { 1.35; }
setMechanical_2 = Orchid.Revit.Materials.PhysicalAsset.SetMechanical(setBasicThermal_3, code_block_11)
setAsset_4 = Orchid.Revit.Materials.Material.SetAsset(create_4, material_aspect_4, setMechanical_2)
watch_7 = Watch(setAsset_4)
name_4 = Material.Name(setAsset_4)
watch_8 = Watch(name_4)

# group: Create material: Steel (S275)
code_block_12 = CodeBlock { "_Steel S275"; }
create_7 = Orchid.Revit.Materials.Material.Create(code_block_12)
material_aspect_5 = MaterialAspectDD("Physical (Structural)")
physical_type_3 = PhysicalTypeDD("Metal")
boolean_5 = BoolSelector(true)
create_8 = Orchid.Revit.Materials.PhysicalAsset.Create(code_block_12, physical_type_3, boolean_5)
code_block_13 = CodeBlock()
# ---------- code_block_13.designscript (6 lines) ----------
"Steel, S275 (EN 10025-2)";
"1.0044,structural,metal,CC:EN 10025";
"thermal,solid";
"Steel";
"Orchid generated";
"https://github.com/erfajo/OrchidForDynamo";
# ----------------------------------------
setInformation_5 = Orchid.Revit.Materials.PhysicalAsset.SetInformation(create_8, code_block_13.out0, code_block_13.out1, code_block_13.out3, code_block_13.out4, code_block_13.out5)
asset_behavior_3 = AssetBehaviorDD("Isotropic")
setBehavior_2 = Orchid.Revit.Materials.PhysicalAsset.SetBehavior(setInformation_5, asset_behavior_3)
code_block_14 = CodeBlock { 0.00001; }
setBasicThermal_4 = Orchid.Revit.Materials.PhysicalAsset.SetBasicThermal(setBehavior_2, code_block_14)
code_block_15 = CodeBlock { 205000; 0.3; 80000; 7850; }
setMechanical_3 = Orchid.Revit.Materials.PhysicalAsset.SetMechanical(setBasicThermal_4, code_block_15.out0, code_block_15.out1, code_block_15.out2, code_block_15.out3)
code_block_16 = CodeBlock { 275; 430; }
boolean_6 = BoolSelector(false)
setStrength = Orchid.Revit.Materials.PhysicalAsset.SetStrength(setMechanical_3, code_block_16.out0, code_block_16.out1, boolean_6)
setAsset_5 = Orchid.Revit.Materials.Material.SetAsset(create_7, material_aspect_5, setStrength)
name_5 = Material.Name(setAsset_5)
watch_9 = Watch(name_5)
watch_10 = Watch(setAsset_5)
material_aspect_6 = MaterialAspectDD("Thermal")
thermal_type_3 = ThermalTypeDD("Solid")
create_9 = Orchid.Revit.Materials.ThermalAsset.Create(code_block_12, thermal_type_3, boolean_5)
setInformation_6 = Orchid.Revit.Materials.ThermalAsset.SetInformation(create_9, code_block_13.out0, code_block_13.out2, code_block_13.out3, code_block_13.out4, code_block_13.out5)
boolean_7 = BoolSelector(false)
asset_behavior_4 = AssetBehaviorDD("Isotropic")
code_block_17 = CodeBlock { 45; 0.48; 7850; 0.4; 0; 0.01; 0; 0; }
setProperties_2 = Orchid.Revit.Materials.ThermalAsset.SetProperties(setInformation_6, boolean_7, asset_behavior_4, code_block_17.out0, code_block_17.out1, code_block_17.out2, code_block_17.out3, code_block_17.out4, code_block_17.out5, code_block_17.out6, code_block_17.out7)
setAsset_6 = Orchid.Revit.Materials.Material.SetAsset(create_7, material_aspect_6, setProperties_2)
name_6 = Material.Name(setAsset_6)
watch_11 = Watch(name_6)
watch_12 = Watch(setAsset_6)

# group: Create material: Timber (C24)
code_block_18 = CodeBlock { "_Timber C24"; }
create_10 = Orchid.Revit.Materials.Material.Create(code_block_18)
material_aspect_7 = MaterialAspectDD("Physical (Structural)")
physical_type_4 = PhysicalTypeDD("Wood")
boolean_8 = BoolSelector(true)
create_11 = Orchid.Revit.Materials.PhysicalAsset.Create(code_block_18, physical_type_4, boolean_8)
code_block_19 = CodeBlock()
# ---------- code_block_19.designscript (6 lines) ----------
"Strength Class C24 Timber";
"Eurocode,Structural,structural,wood,CC:EN 338";
"Wood,thermal,solid";
"Wood";
"Orchid generated";
"https://github.com/erfajo/OrchidForDynamo";
# ----------------------------------------
setInformation_7 = Orchid.Revit.Materials.PhysicalAsset.SetInformation(create_11, code_block_19.out0, code_block_19.out1, code_block_19.out3, code_block_19.out4, code_block_19.out5)
asset_behavior_5 = AssetBehaviorDD("Orthotropic")
setBehavior_3 = Orchid.Revit.Materials.PhysicalAsset.SetBehavior(setInformation_7, asset_behavior_5)
code_block_20 = CodeBlock { 0.00004; }
setBasicThermal_5 = Orchid.Revit.Materials.PhysicalAsset.SetBasicThermal(setBehavior_3, code_block_20)
code_block_21 = CodeBlock { 11000; 0.38; 690; 420; }
setMechanical_4 = Orchid.Revit.Materials.PhysicalAsset.SetMechanical(setBasicThermal_5, code_block_21.out0, code_block_21.out1, code_block_21.out2, code_block_21.out3)
code_block_22 = CodeBlock { "Multiple"; "C24"; 24; 21; 2.5; 4; 14; 0.5; 11000; }
wood_construction = WoodConstructionDD("Natural")
setStrength_2 = Orchid.Revit.Materials.PhysicalAsset.SetStrength(setMechanical_4, code_block_22.out0, code_block_22.out1, code_block_22.out2, code_block_22.out3, code_block_22.out4, code_block_22.out5, code_block_22.out6, code_block_22.out7, code_block_22.out8, wood_construction)
setAsset_7 = Orchid.Revit.Materials.Material.SetAsset(create_10, material_aspect_7, setStrength_2)
name_7 = Material.Name(setAsset_7)
watch_13 = Watch(name_7)
watch_14 = Watch(setAsset_7)
material_aspect_8 = MaterialAspectDD("Thermal")
thermal_type_4 = ThermalTypeDD("Solid")
create_12 = Orchid.Revit.Materials.ThermalAsset.Create(code_block_18, thermal_type_4, boolean_8)
setInformation_8 = Orchid.Revit.Materials.ThermalAsset.SetInformation(create_12, code_block_19.out0, code_block_19.out2, code_block_19.out3, code_block_19.out4, code_block_19.out5)
boolean_9 = BoolSelector(false)
asset_behavior_6 = AssetBehaviorDD("Isotropic")
code_block_23 = CodeBlock { 0.12; 0.19; 496; 0.85; 0; 0.01; 0; 10000000; }
setProperties_3 = Orchid.Revit.Materials.ThermalAsset.SetProperties(setInformation_8, boolean_9, asset_behavior_6, code_block_23.out0, code_block_23.out1, code_block_23.out2, code_block_23.out3, code_block_23.out4, code_block_23.out5, code_block_23.out6, code_block_23.out7)
setAsset_8 = Orchid.Revit.Materials.Material.SetAsset(create_10, material_aspect_8, setProperties_3)
name_8 = Material.Name(setAsset_8)
watch_15 = Watch(name_8)
watch_16 = Watch(setAsset_8)

# group: Create material: Timber (C24) --> XYZ values for SetBasicThermal and SetMechanical
code_block_24 = CodeBlock { "_Timber C24 (XYZ)"; }
create_13 = Orchid.Revit.Materials.Material.Create(code_block_24)
material_aspect_9 = MaterialAspectDD("Thermal")
thermal_type_5 = ThermalTypeDD("Solid")
boolean_10 = BoolSelector(true)
create_14 = Orchid.Revit.Materials.ThermalAsset.Create(code_block_24, thermal_type_5, boolean_10)
code_block_25 = CodeBlock()  # same code as code_block_19
setInformation_9 = Orchid.Revit.Materials.ThermalAsset.SetInformation(create_14, code_block_25.out0, code_block_25.out2, code_block_25.out3, code_block_25.out4, code_block_25.out5)
boolean_11 = BoolSelector(false)
asset_behavior_7 = AssetBehaviorDD("Isotropic")
code_block_26 = CodeBlock { 0.12; 0.19; 496; 0.85; 0; 0.01; 0; 10000000; }
setProperties_4 = Orchid.Revit.Materials.ThermalAsset.SetProperties(setInformation_9, boolean_11, asset_behavior_7, code_block_26.out0, code_block_26.out1, code_block_26.out2, code_block_26.out3, code_block_26.out4, code_block_26.out5, code_block_26.out6, code_block_26.out7)
setAsset_9 = Orchid.Revit.Materials.Material.SetAsset(create_13, material_aspect_9, setProperties_4)
watch_17 = Watch(setAsset_9)
name_9 = Material.Name(setAsset_9)
watch_18 = Watch(name_9)
material_aspect_10 = MaterialAspectDD("Physical (Structural)")
physical_type_5 = PhysicalTypeDD("Wood")
create_15 = Orchid.Revit.Materials.PhysicalAsset.Create(code_block_24, physical_type_5, boolean_10)
setInformation_10 = Orchid.Revit.Materials.PhysicalAsset.SetInformation(create_15, code_block_25.out0, code_block_25.out1, code_block_25.out3, code_block_25.out4, code_block_25.out5)
asset_behavior_8 = AssetBehaviorDD("Orthotropic")
setBehavior_4 = Orchid.Revit.Materials.PhysicalAsset.SetBehavior(setInformation_10, asset_behavior_8)
code_block_27 = CodeBlock { {0.0001,0.0002,0.0003}; }
setBasicThermal_6 = Orchid.Revit.Materials.PhysicalAsset.SetBasicThermal(setBehavior_4, code_block_27)
code_block_28 = CodeBlock { {10000,11000,12000}; {0.3,0.35,0.4}; {650,700,750}; 420; }
code_block_29 = CodeBlock { 0.3; 0.35; 0.4; }
byCoordinates = Vector.ByCoordinates(x=code_block_29.out0, y=code_block_29.out1, z=code_block_29.out2)
code_block_30 = CodeBlock { 650; 700; 750; }
byCoordinates_2 = Point.ByCoordinates(x=code_block_30.out0, y=code_block_30.out1, z=code_block_30.out2)
setMechanical_5 = Orchid.Revit.Materials.PhysicalAsset.SetMechanical(setBasicThermal_6, code_block_28.out0, byCoordinates, byCoordinates_2, code_block_28.out3)
code_block_31 = CodeBlock { "Multiple"; "C24"; 24; 21; 2.5; 4; 14; 0.5; 11000; }
wood_construction_2 = WoodConstructionDD("Natural")
setStrength_3 = Orchid.Revit.Materials.PhysicalAsset.SetStrength(setMechanical_5, code_block_31.out0, code_block_31.out1, code_block_31.out2, code_block_31.out3, code_block_31.out4, code_block_31.out5, code_block_31.out6, code_block_31.out7, code_block_31.out8, wood_construction_2)
setAsset_10 = Orchid.Revit.Materials.Material.SetAsset(create_13, material_aspect_10, setStrength_3)
watch_19 = Watch(setAsset_10)
name_10 = Material.Name(setAsset_10)
watch_20 = Watch(name_10)
