# Dynamo graph File+Fam-LoadFamily.dyn (Dynamo 2.1.0.7500)

# group: Open all files in directory and sub directories
string = StringInput(".\testSet")  # graph input
code_block = CodeBlock { "*.rvt"; }
boolean = BoolSelector(false)  # graph input
contents = Orchid.Core.Directory.Contents(directory=string, searchString=code_block, deepSearch=boolean)

# group: Open all files in directory and sub directories
string_2 = StringInput(".\testSet")  # graph input
code_block_2 = CodeBlock { "*.rfa"; }
boolean_2 = BoolSelector(false)  # graph input
contents_2 = Orchid.Core.Directory.Contents(directory=string_2, searchString=code_block_2, deepSearch=boolean_2)

loadFamily = Orchid.Core.File.LoadFamily(document=contents, family=contents_2)  # frozen
watch = Watch(loadFamily)
loadFamily_2 = Orchid.Core.File.LoadFamily(family=contents_2)
watch_2 = Watch(loadFamily_2)

# group: Open all files in directory and sub directories
string_3 = StringInput(".\testSet")  # graph input
code_block_3 = CodeBlock { "*.rfa"; }
boolean_3 = BoolSelector(false)  # graph input
contents_3 = Orchid.Core.Directory.Contents(directory=string_3, searchString=code_block_3, deepSearch=boolean_3)  # frozen
backgroundOpen = Orchid.RevitProject.Document.BackgroundOpen(file=contents_3)

loadFamily_3 = Orchid.RevitFamily.Document.LoadFamily(familyDocument=backgroundOpen)
watch_3 = Watch(loadFamily_3)
await_ = Orchid.Core.DataStream.Await(pass=backgroundOpen, waitFor=loadFamily_3)

# group: Close files
close = Orchid.RevitProject.Document.Close(document=await_)
