# Dynamo graph SystemFamilyType.dyn (Dynamo 2.0.3.8810)

wall_types = WallTypes(index=0)  # graph input
thermalProperties = Orchid.RevitProject.Elements.SystemFamilyType.ThermalProperties(elementType=wall_types)
watch = Watch(thermalProperties.HeatTransferCoefficient)
watch_2 = Watch(thermalProperties.ThermalResistance)
watch_3 = Watch(thermalProperties.ThermalMass)
watch_4 = Watch(thermalProperties.Absorptance)
watch_5 = Watch(thermalProperties.Roughness)
function = Orchid.RevitProject.Elements.WallType.Function(wallType=wall_types)
watch_6 = Watch(function)
kind = Orchid.RevitProject.Elements.WallType.Kind(wallType=wall_types)
watch_7 = Watch(kind)
width = Orchid.RevitProject.Elements.WallType.Width(wallType=wall_types)
watch_8 = Watch(width)

# group: Floor
floor_types = FloorTypes(index=2)  # graph input
structuralMaterial = Orchid.RevitProject.Elements.FloorType.StructuralMaterial(FloorType=floor_types)
watch_9 = Watch(structuralMaterial)
isFoundationSlab = Orchid.RevitProject.Elements.FloorType.IsFoundationSlab(FloorType=floor_types)
watch_10 = Watch(isFoundationSlab)
thermalProperties_2 = Orchid.RevitProject.Elements.SystemFamilyType.ThermalProperties(elementType=floor_types)
watch_11 = Watch(thermalProperties_2.Roughness)
watch_12 = Watch(thermalProperties_2.Absorptance)
watch_13 = Watch(thermalProperties_2.ThermalMass)
watch_14 = Watch(thermalProperties_2.ThermalResistance)
watch_15 = Watch(thermalProperties_2.HeatTransferCoefficient)

# group: Ceiling
ceiling_types = CeilingTypes(index=1)  # graph input
thermalProperties_3 = Orchid.RevitProject.Elements.SystemFamilyType.ThermalProperties(elementType=ceiling_types)
watch_16 = Watch(thermalProperties_3.HeatTransferCoefficient)
watch_17 = Watch(thermalProperties_3.ThermalResistance)
watch_18 = Watch(thermalProperties_3.ThermalMass)
watch_19 = Watch(thermalProperties_3.Absorptance)
watch_20 = Watch(thermalProperties_3.Roughness)

# group: Roof
roof_types = RoofTypes(index=1)  # graph input
thermalProperties_4 = Orchid.RevitProject.Elements.SystemFamilyType.ThermalProperties(elementType=roof_types)
watch_21 = Watch(thermalProperties_4.Roughness)
watch_22 = Watch(thermalProperties_4.Absorptance)
watch_23 = Watch(thermalProperties_4.ThermalMass)
watch_24 = Watch(thermalProperties_4.ThermalResistance)
watch_25 = Watch(thermalProperties_4.HeatTransferCoefficient)
