# Dynamo graph Workset.dyn "Workset_beta" (Dynamo 2.0.3.8810)

categories = Categories(index=604)
all_elements_of_category = ElementsOfCategory(Category=categories)
getWorkset = Orchid.RevitProject.Elements.Element.GetWorkset(element=all_elements_of_category)
watch = Watch(getWorkset)
all = Orchid.RevitProject.Common.Workset.All()
name = Orchid.RevitProject.Common.Workset.Name(workset=all)
watch_2 = Watch(name)
id = Orchid.RevitProject.Common.Workset.Id(workset=all)
watch_3 = Watch(id)
guid = Orchid.RevitProject.Common.Workset.Guid(workset=all)
watch_4 = Watch(guid)
watch_5 = Watch(all)

# group: Worksets
worksets = Worksets(index=0)
watch_6 = Watch(worksets)

byId = Orchid.RevitProject.Common.Workset.ById(id=id)
watch_7 = Watch(byId)
code_block = CodeBlock { "something"; }
setByName = Orchid.RevitProject.Common.Workset.SetByName(name=code_block)  # frozen
getByName = Orchid.RevitProject.Common.Workset.GetByName(name=name)
watch_8 = Watch(getByName)
getByName_2 = Orchid.RevitProject.Common.Workset.GetByName(name=code_block)  # frozen
setWorkset = Orchid.RevitProject.Elements.Element.SetWorkset(element=all_elements_of_category, workset=getByName_2)

# group: Selection
built_in_categories = CodeBlock()
# ---------- built_in_categories.designscript (26 lines) ----------
[
"OST_Casework",
"OST_Ceilings",
"OST_Columns",
"OST_CurtainWallMullions",
"OST_CurtainWallPanels",
"OST_CurtaSystem",
"OST_Doors",
"OST_Entourage",
"OST_Floors",
"OST_Furniture",
"OST_FurnitureSystems",
"OST_GenericModel",
"OST_PlumbingFixtures",
"OST_Ramps",
"OST_Roofs",
"OST_SpecialityEquipment",
"OST_Stairs",
"OST_StructuralColumns",
"OST_StructuralFoundation",
"OST_StructuralFraming",
"OST_StructuralFramingSystem",
"OST_StructuralStiffener",
"OST_Walls",
"OST_Windows"
];
# ----------------------------------------
natural_category_name = CodeBlock()
# ---------- natural_category_name.designscript (26 lines) ----------
[
"Casework",
"Ceilings",
"Columns",
"Curtain Wall Mullions",
"Curtain Panels",
"Curtain Systems",
"Doors",
"Entourage",
"Floors",
"Furniture",
"Furniture Systems",
"Generic Models",
"Plumbing Fixtures",
"Ramps",
"Roofs",
"Specialty Equipment",
"Stairs",
"Structural Columns",
"Structural Foundations",
"Structural Framing",
"Structural Beam Systems",
"Structural Stiffeners",
"Walls",
"Windows"
];
# ----------------------------------------
elementByCategory = Orchid.RevitProject.Elements.Selection.ElementByCategory(category=natural_category_name)  # frozen
code_block_2 = CodeBlock { "Workset text"; }
getWorkset_2 = Orchid.RevitProject.Elements.Element.GetWorkset(element=elementByCategory.Element)
name_2 = Orchid.RevitProject.Common.Workset.Name(workset=getWorkset_2)
setParameterByName = Element.SetParameterByName(element=elementByCategory.Element, parameterName=code_block_2, value=name_2)

# group: Selection
code_block_3 = CodeBlock()
# ---------- code_block_3.designscript (9 lines) ----------
"Model";
"Annotation";
"AnalyticalModel";
"Internal";

["Model",
"Annotation",
"AnalyticalModel",
"Internal"];
# ----------------------------------------
elementByCategoryType = Orchid.RevitProject.Elements.Selection.ElementByCategoryType(categoryType=code_block_3.out0)
code_block_4 = CodeBlock { "Workset text"; }
getWorkset_3 = Orchid.RevitProject.Elements.Element.GetWorkset(element=elementByCategoryType.Element)
name_3 = Orchid.RevitProject.Common.Workset.Name(workset=getWorkset_3)
setParameterByName_2 = Element.SetParameterByName(element=elementByCategoryType.Element, parameterName=code_block_4, value=name_3)

# group: Selection
elementHasMaterial = Orchid.RevitProject.Elements.Selection.ElementHasMaterial()  # frozen
code_block_5 = CodeBlock { "Workset text"; }
getWorkset_4 = Orchid.RevitProject.Elements.Element.GetWorkset(element=elementHasMaterial.Element)
name_4 = Orchid.RevitProject.Common.Workset.Name(workset=getWorkset_4)
setParameterByName_3 = Element.SetParameterByName(element=elementHasMaterial.Element, parameterName=code_block_5, value=name_4)
