# Dynamo graph Filter.dyn (Dynamo 2.0.3.8810)

select_rule_type = RuleTypes(index=5)
code_block = CodeBlock { "test1"; "test2"; }
code_block_2 = CodeBlock { "TestProjectParameter"; "Equals"; "Something"; }
byName = Orchid.RevitProject.Parameters.Parameter.ByName(name=code_block_2.out0)
rule = Orchid.RevitProject.Common.Filter.Rule(parameter=byName, ruletype=code_block_2.out1, value=code_block_2.out2)
code_block_3 = CodeBlock { ["Doors","Windows"]; }
byName_2 = Category.ByName(name=code_block_3)
boolean = BoolSelector(true)
byRule = Orchid.RevitProject.Common.Filter.ByRule(name=code_block.out1, rule=rule, category=byName_2, andOr=boolean)
rule_2 = Orchid.RevitProject.Common.Filter.Rule(parameterName=code_block_2.out0, ruletype=code_block_2.out1, value=code_block_2.out2)
byRule_2 = Orchid.RevitProject.Common.Filter.ByRule(name=code_block.out0, rule=rule_2, category=byName_2, andOr=boolean)
name = Orchid.RevitProject.Parameters.Parameter.Name(parameter=byName)
id = Orchid.RevitProject.Parameters.Parameter.Id(parameter=byName)
