# Dynamo graph Ifc.dyn (Dynamo 2.0.3.8810)

# group: Prebuild IFC setting
ifc_setting = Setting(index=9)  # graph input
settingByName = Orchid.RevitProject.Common.IFC.SettingByName(name=ifc_setting)

# group: IFC setting --> General
ifc_space_boundary = SpaceBoundary(index=1)  # graph input
ifc_project_origin = SitePlacement(index=3)  # graph input
boolean = BoolSelector(true)  # graph input
settingGeneral = Orchid.RevitProject.Common.IFC.SettingGeneral(setting=settingByName, spaceBoundary=ifc_space_boundary, projectOrigin=ifc_project_origin, splitByLevel=boolean)
ifc_file_type = FileType(index=0)  # graph input
ifc_version = Version(index=8)  # graph input

# group: IFC setting --> Additional/LOD
boolean_2 = BoolSelector(true)  # graph input
ifc_level_of_detail = LevelOfDetail(index=2)  # graph input
settingAdditional = Orchid.RevitProject.Common.IFC.SettingAdditional(setting=settingGeneral, VisibleElements=boolean_2, LOD=ifc_level_of_detail)

# group: IFC setting --> Property
boolean_3 = BoolSelector(true)  # graph input
code_block = CodeBlock { t1 = Orchid.Core.Directory.Current; t2 = "test"; t1+"\\"+t2; }
settingProperty = Orchid.RevitProject.Common.IFC.SettingProperty(setting=settingAdditional, baseQuantities=boolean_3, userPropertyFile=code_block.out2)

# group: IFC setting --> Advanced
boolean_4 = BoolSelector(true)  # graph input
settingAdvanced = Orchid.RevitProject.Common.IFC.SettingAdvanced(setting=settingProperty, storeGuid=boolean_4)

# group: IFC setting file format
type = Object.Type(obj=settingAdvanced)
watch = Watch(type)
watch_2 = Watch(settingAdvanced)

# group: IFC Export
current = Orchid.Core.Directory.Current()
string = StringInput("test")  # graph input
code_block_2 = CodeBlock(t1=current, t2=string) { t1+"\\"+t2; }
views = Views(index=0)  # graph input
boolean_5 = BoolSelector(true)  # graph input
export = Orchid.RevitProject.Common.IFC.Export(setting=settingAdvanced, view=views, overwrite=boolean_5)
watch_3 = Watch(export)
phases = Phase(index=0)

# group: IFC Export --> Multiple document export
string_2 = StringInput(".\defaultBuilding_2019.rvt")
backgroundOpen = Orchid.RevitProject.Common.Document.BackgroundOpen(file=string_2)
export_2 = Orchid.RevitProject.Common.IFC.Export(document=backgroundOpen)
await_ = Orchid.Core.DataStream.Await(pass=backgroundOpen, waitFor=export_2)
close = Orchid.RevitProject.Common.Document.Close(document=await_)
watch_4 = Watch(export_2)

# group: IFC Export based on prebuild IFC setting and a view
ifc_setting_2 = Setting(index=1)  # graph input
settingByName_2 = Orchid.RevitProject.Common.IFC.SettingByName(name=ifc_setting_2)
views_2 = Views(index=0)  # graph input
export_3 = Orchid.RevitProject.Common.IFC.Export(setting=settingByName_2, view=views_2)
