# Dynamo graph LinkedDocument.dyn (Dynamo 2.0.3.8810)

string = StringInput("%userprofile%\Programming\Source\Testing\Data\")  # graph input
string_2 = StringInput("2019_defaultProject")  # graph input
code_block = CodeBlock(a=string, b=string_2) { a+b+".rvt"; }
fromPath = Orchid.Core.File.FromPath(path=code_block)

# group: Revit links
linkedRevitFile = Orchid.RevitProject.Common.Link.LinkedRevitFile()
linkReload = Orchid.RevitProject.Common.Link.LinkReload(link=linkedRevitFile)  # frozen
linkRepath = Orchid.RevitProject.Common.Link.LinkRepath(link=linkedRevitFile, file=fromPath)  # frozen
linkUnload = Orchid.RevitProject.Common.Link.LinkUnload(link=linkedRevitFile)  # frozen
watch = Watch(linkedRevitFile)
name = Element.Name(element=linkedRevitFile)
watch_2 = Watch(name)

# group: CAD links
linkedCadFile = Orchid.RevitProject.Common.Link.LinkedCadFile()
watch_3 = Watch(linkedCadFile)
name_2 = Element.Name(element=linkedCadFile)
watch_4 = Watch(name_2)
linkReload_2 = Orchid.RevitProject.Common.Link.LinkReload(link=linkedCadFile)
watch_5 = Watch(linkReload_2)

# group: Get all linked files
linkedFile = Orchid.RevitProject.Common.Link.LinkedFile()
watch_6 = Watch(linkedFile.Type)
watch_7 = Watch(linkedFile.Link)

# group: Dropdown selector
linked_files = LinkedFile(index=1)  # graph input
watch_8 = Watch(linked_files)
linked_revit_files = LinkedRevit(index=0)  # graph input
watch_9 = Watch(linked_revit_files)
linked_cad_files = LinkedCad(index=0)  # graph input
watch_10 = Watch(linked_cad_files)

# group: Convert to Revit link
select_model_element = DSModelElementSelection()  # 1 picked in the model; graph input; frozen
watch_11 = Watch(select_model_element)
convertToLink = Orchid.RevitProject.Common.Link.ConvertToLink(instance=select_model_element)
watch_12 = Watch(convertToLink)

# group: Convert to CAD link
select_model_element_2 = DSModelElementSelection()  # 1 picked in the model; graph input; frozen
watch_13 = Watch(select_model_element_2)
convertToLink_2 = Orchid.RevitProject.Common.Link.ConvertToLink(instance=select_model_element_2)
watch_14 = Watch(convertToLink_2)

# group: Link cad file
string_3 = StringInput(".\Drawing1.dwg")
model_views = ModelView(index=0)
linkCadFile = Orchid.RevitProject.Common.Link.LinkCadFile(file=string_3, view=model_views)
watch_15 = Watch(linkCadFile.Instance)
watch_16 = Watch(linkCadFile.Link)
boolean = BoolSelector(false)

# group: Link revit file
string_4 = StringInput(".\defaultBuilding_2019.rvt")
code_block_2 = CodeBlock { 10000; }
byCoordinates = Vector.ByCoordinates(x=code_block_2, y=code_block_2)
linkRevitFile = Orchid.RevitProject.Common.Link.LinkRevitFile(file=string_4, location=byCoordinates)
watch_17 = Watch(linkRevitFile.Link)
watch_18 = Watch(linkRevitFile.Instance)
boolean_2 = BoolSelector(false)
