# Dynamo graph MoveToOrigin.dyn "MoveToOrigin_NY" (Dynamo 2.0.3.8810)

# group: new origin -> as vector
select_model_element = DSModelElementSelection()  # 1 picked in the model
getLocation = Element.GetLocation(element=select_model_element)
reverse = Orchid.Core.Geometry.Point.Reverse(point=getLocation)

# group: Adjust view crop box
modelAll = Orchid.RevitProject.Views.View.ModelAll()
move = Orchid.RevitProject.Views.View.Move(view=modelAll, point=reverse)

# group: Adjust sectionsbox
code_block = CodeBlock { "3D View"; }
byName = Orchid.RevitProject.Views.ViewType.ByName(name=code_block)
byType = Orchid.RevitProject.Views.View.ByType(viewType=byName)
moveSectionBox = Orchid.RevitProject.Views.View.MoveSectionBox(view3D=byType, point=reverse)

# group: copy the coordinates to clipboard
copyTo = Orchid.Core.Clipboard.CopyTo(element=reverse)

# group: Revisions -> delete or add
deleteAll = Orchid.RevitProject.Common.Revision.DeleteAll()  # frozen
# note: If revisions is deleted, then remember to
# remove they are added to the "move" list
deleteAll_2 = Orchid.RevitProject.Common.RevisionCloud.DeleteAll()  # frozen
all = Orchid.RevitProject.Common.RevisionCloud.All()

# group: Select special elements
code_block_2 = CodeBlock { "MultistoryStairs"; }
byName_2 = Orchid.RevitProject.Elements.Types.ByName(name=code_block_2)
all_elements_of_type = ElementsOfType(element_type=byName_2)
allStackedWall = Orchid.RevitProject.Elements.Wall.AllStackedWall()
allModel = Orchid.RevitProject.Elements.Group.AllModel()
getSeparationLine = Orchid.RevitProject.Elements.SpatialElement.GetSeparationLine()
list_create = List.Create(item0=all_elements_of_type, item1=allStackedWall, item2=allModel, item3=getSeparationLine.Element)

# group: Select model elements
code_block_3 = CodeBlock()
# ---------- code_block_3.designscript (5 lines) ----------
// Category type elements
"Model";
"Annotation";
"AnalyticalModel";
"Internal";
# ----------------------------------------
elementByCategoryType = Orchid.RevitProject.Elements.Selection.ElementByCategoryType(categoryType=code_block_3.out0)

# group: Select annotation elements
code_block_4 = CodeBlock()
# ---------- code_block_4.designscript (2 lines) ----------
// Category type elements
"Annotation";
# ----------------------------------------
elementByCategoryType_2 = Orchid.RevitProject.Elements.Selection.ElementByCategoryType(categoryType=code_block_4)
code_block_5 = CodeBlock(category=elementByCategoryType_2.Category)
# ---------- code_block_5.designscript (3 lines) ----------
category.Name == "Section Boxes" ||
category.Name == "Revision Clouds"
? true : false;
# ----------------------------------------
filterByBoolMask = List.FilterByBoolMask(list=elementByCategoryType_2.Element, mask=code_block_5)

# group: create group
code_block_6 = CodeBlock { "dummy"; }
join = List.Join(list0=list_create, list1=elementByCategoryType.Element, list2=filterByBoolMask.out)
clean = Orchid.Core.List.Clean(list=join)
flatten = List.Flatten(list=clean)
create = Orchid.RevitProject.Elements.Group.Create(name=code_block_6, element=flatten)

# group: Select additional elements that not can be grouped
allDetail = Orchid.RevitProject.Elements.Group.AllDetail()
ownerViewType = Orchid.RevitProject.Elements.Element.OwnerViewType(element=allDetail)
code_block_7 = CodeBlock(t=ownerViewType) { t != "Detail"? true : false; }
filterByBoolMask_2 = List.FilterByBoolMask(list=allDetail, mask=code_block_7)

# group: join lists and unpin element
join_2 = List.Join(list0=filterByBoolMask_2.in, list1=all)
flatten_2 = List.Flatten(list=join_2)
isPinned = Orchid.RevitProject.Elements.Element.IsPinned(element=flatten_2)
filterByBoolMask_3 = List.FilterByBoolMask(list=flatten_2, mask=isPinned)
unPin = Orchid.RevitProject.Elements.Element.UnPin(element=filterByBoolMask_3.in)

# group: Adjust model
join_3 = List.Join(list0=create, list1=filterByBoolMask_3.out, list2=unPin)
move_2 = Orchid.RevitProject.Elements.Element.Move(element=join_3, point=reverse)
await_ = Orchid.Core.DataStream.Await(pass=create, waitFor=move_2)
getByGroup = Orchid.RevitProject.Elements.GroupType.GetByGroup(group=await_)
unGroup = Orchid.RevitProject.Elements.Group.UnGroup(group=await_)
await_2 = Orchid.Core.DataStream.Await(pass=getByGroup, waitFor=unGroup)
delete = Orchid.RevitProject.Elements.GroupType.Delete(name=await_2)
clean_2 = Orchid.Core.List.Clean(list=unPin)
await_3 = Orchid.Core.DataStream.Await(pass=clean_2, waitFor=unGroup)
pin = Orchid.RevitProject.Elements.Element.Pin(element=await_3)
