# Dynamo graph Parameter.dyn (Dynamo 2.0.3.8810)

# group: Add project parameter
code_block = CodeBlock()
# ---------- code_block.designscript (14 lines) ----------
//Parameter name
["test1","test2"];
//Parameter type
"Text";
//Parameter group
"PG_IDENTITY_DATA";
//Tooltip
"Some tooltip";
//Instances
true;
//Vary Between Groups
true;
//Category
["Walls","Windows"];
# ----------------------------------------
byName = Category.ByName(name=code_block.out6)
add = Orchid.RevitProject.Parameters.ProjectParameter.Add(parameterName=code_block.out0, type=code_block.out1, group=code_block.out2, tooltip=code_block.out3, instance=code_block.out4, vary=code_block.out5, category=byName)

# group: Add shared parameter
code_block_2 = CodeBlock()
# ---------- code_block_2.designscript (17 lines) ----------
//Parameter name
["Creator Name",
"Creator Organization",
"Creator Build"];
//{"Paper Size","Subject"};
//SP Parameter group
"Sheet & Project";
//SP Parameter type
"Text";
//Parameter group
"PG_ADSK_MODEL_PROPERTIES";
//Instances
true;
//Vary Between Groups
true;
//Category
"Doors";
# ----------------------------------------
byName_2 = Category.ByName(name=code_block_2.out6)
add_2 = Orchid.RevitProject.Parameters.SharedParameter.Add(parameterName=code_block_2.out0, groupName=code_block_2.out1, type=code_block_2.out2, group=code_block_2.out3, category=byName_2)

# group: Change parameter and category binding in the project
code_block_3 = CodeBlock()
# ---------- code_block_3.designscript (8 lines) ----------
//Parameter name
"Creator Name";
//Instances
true;
//Category
["Doors",
"Entourage",
"Floors"];
# ----------------------------------------
byName_3 = Category.ByName(name=code_block_3.out2)
changeCategory = Orchid.RevitProject.Parameters.Parameter.ChangeCategory(parameterName=code_block_3.out0, category=byName_3)  # frozen

# group: Delete parameter
code_block_4 = CodeBlock()
# ---------- code_block_4.designscript (2 lines) ----------
["Creator Build",
"test2"];
# ----------------------------------------
delete = Orchid.RevitProject.Parameters.Parameter.Delete(parameterName=code_block_4)  # frozen

# group: Project parameters in document
projectParameters = Orchid.RevitProject.Common.Document.ProjectParameters()
watch = Watch(projectParameters)
name = Element.Name(element=projectParameters)
watch_2 = Watch(name)

# group: Global parameters in document
globalParameters = Orchid.RevitProject.Common.Document.GlobalParameters()
watch_3 = Watch(globalParameters)
name_2 = Element.Name(element=globalParameters)
watch_4 = Watch(name_2)

# group: Shared parameters in document
sharedParameters = Orchid.RevitProject.Common.Document.SharedParameters()
name_3 = Element.Name(element=sharedParameters.parameter)
watch_5 = Watch(name_3)
watch_6 = Watch(sharedParameters.parameter)
watch_7 = Watch(sharedParameters.guid)

# group: clean for unwanted parameters
string = StringInput("ParameterCopy")  # graph input
contains = String.Contains(str=name_3, searchFor=string)
filterByBoolMask = List.FilterByBoolMask(list=sharedParameters.parameter, mask=contains)
delete_2 = Orchid.RevitProject.Elements.Element.Delete(element=filterByBoolMask.in)  # frozen
name_4 = Element.Name(element=filterByBoolMask.in)
watch_8 = Watch(name_4)
watch_9 = Watch(filterByBoolMask.in)

# group: Add basic IFC parameter
addIFC = Orchid.RevitProject.Parameters.ProjectParameter.AddIFC()  # frozen

# group: Associate --> global parameters
categories = Categories(index=619)  # graph input; frozen
all_elements_of_category = ElementsOfCategory(Category=categories)
code_block_5 = CodeBlock { "test2"; }
associate = Orchid.RevitProject.Parameters.GlobalParameter.Associate(element=all_elements_of_category, parameterName=code_block_5, globalParameter=globalParameters, lacing=Longest)
await_ = Orchid.Common.DataStream.Await(pass=all_elements_of_category, waitFor=associate)
getAssociated = Orchid.RevitProject.Parameters.GlobalParameter.GetAssociated(element=await_, parameterName=code_block_5)
watch_10 = Watch(getAssociated)
hasAssociated = Orchid.RevitProject.Parameters.GlobalParameter.HasAssociated(element=await_, parameterName=code_block_5)
watch_11 = Watch(hasAssociated)

# group: Create shared parameter
code_block_6 = CodeBlock()
# ---------- code_block_6.designscript (16 lines) ----------
//Parameter name
"Dynamo test parameter";
//SP Parameter group
"Dynamo test group";
//SP Parameter type
"Text";
//Parameter group
"PG_ADSK_MODEL_PROPERTIES";
//Tooltip
"Some tooltip";
//Instances
true;
//Vary Between Groups
true;
//Category
"Doors";
# ----------------------------------------
byName_4 = Category.ByName(name=code_block_6.out7)
create = Orchid.RevitProject.Parameters.SharedParameter.Create(parameterName=code_block_6.out0, groupName=code_block_6.out1, type=code_block_6.out2, group=code_block_6.out3, category=byName_4)  # frozen
add_3 = Orchid.RevitProject.Parameters.SharedParameter.Add(parameterName=code_block_6.out0, groupName=code_block_6.out1, type=code_block_6.out2, group=code_block_6.out3, instance=code_block_6.out5, vary=code_block_6.out6, category=byName_4)  # frozen
