# Dynamo graph Project.dyn (Dynamo 2.1.0.7500)

# group: Project phase
phases = Phase("New Construction")  # graph input
watch = Watch(phases)

# group: Project location
project_origin = Origin("Internal")  # graph input
setProjectLocation = Orchid.RevitProject.Project.SetProjectLocation(origin=project_origin)
watch_2 = Watch(setProjectLocation)
getProjectLocation = Orchid.RevitProject.Project.GetProjectLocation()
watch_3 = Watch(getProjectLocation)
