# Dynamo graph Purge PostCommand.dyn (Dynamo 2.1.0.7500)

# group: orchid
boolean = BoolSelector(false)  # graph input
purge = Orchid.RevitProject.Document.Purge(completely=boolean)

# group: orchid
boolean_2 = BoolSelector(false)  # graph input
purge_2 = Orchid.RevitProject.PostCommand.Purge(activate=boolean_2)  # frozen
