# Dynamo graph Revisions.dyn (Dynamo 2.0.3.8810)

# group: All
all = Orchid.RevitProject.Common.Revision.All()
watch = Watch(all)
lastItem = List.LastItem(list=all)
delete = Orchid.RevitProject.Common.Revision.Delete(revision=lastItem)  # frozen

# group: RevisionCloud
all_2 = Orchid.RevitProject.Common.RevisionCloud.All()  # frozen
delete_2 = Orchid.RevitProject.Common.RevisionCloud.Delete(revisionCloud=all_2)
watch_2 = Watch(delete_2)
revision = RevisionCloud.Revision(revisionCloud=all_2)

# group: Get
revisions = Revision(index=0)
name = Element.Name(element=revisions)
get = Orchid.RevitProject.Common.Revision.Get(revision=revisions)

# group: Add to Sheet / Remove from Sheet
sheet_views = SheetView(index=0)
revisions_2 = Revision(index=0)
addToSheet = Orchid.RevitProject.Common.Revision.AddToSheet(sheet=sheet_views, revision=revisions_2)  # frozen
removeFromSheet = Orchid.RevitProject.Common.Revision.RemoveFromSheet(sheet=sheet_views, revision=revisions_2)  # frozen

# group: DeleteAll
deleteAll = Orchid.RevitProject.Common.Revision.DeleteAll()  # frozen
watch_3 = Watch(deleteAll)

# group: Numbering
getNumbering = Orchid.RevitProject.Common.Revision.GetNumbering()
select_revision_numbering = RevisionNumbering(index=0)  # frozen
setNumbering = Orchid.RevitProject.Common.Revision.SetNumbering(numbering=select_revision_numbering)

# group: Set
revisions_3 = Revision(index=0)
code_block = CodeBlock { "Date 1234"; "Some description"; true; "AAA"; "BBB"; }
select_revision_visibility = RevisionVisibility(index=2)
select_revision_number_type = RevisionNumberType(index=2)
set = Orchid.RevitProject.Common.Revision.Set(revision=revisions_3, revDate=code_block.out0, description=code_block.out1, issued=code_block.out2, issuedTo=code_block.out3, issuedBy=code_block.out4, visibility=select_revision_visibility, numberType=select_revision_number_type)

# group: Create
code_block_2 = CodeBlock { "Date 1234"; "Some description"; true; "AAA"; "BBB"; }  # frozen
select_revision_visibility_2 = RevisionVisibility(index=0)
select_revision_number_type_2 = RevisionNumberType(index=2)
create = Orchid.RevitProject.Common.Revision.Create(revDate=code_block_2.out0, description=code_block_2.out1, issued=code_block_2.out2, issuedTo=code_block_2.out3, issuedBy=code_block_2.out4, visibility=select_revision_visibility_2, numberType=select_revision_number_type_2)

# group: DeleteAll
deleteAll_2 = Orchid.RevitProject.Common.RevisionCloud.DeleteAll()  # frozen
watch_4 = Watch(deleteAll_2)
