# Dynamo graph SharedParameter.dyn (Dynamo 2.0.3.8810)

string = StringInput("..\COBie Extension Shared Parameters.txt")  # graph input
setFile = Orchid.RevitProject.Parameters.SharedParameter.SetFile(file=string)
watch = Watch(setFile)

# group: Do Stuff
boolean = BoolSelector(true)  # graph input
circut = Orchid.Core.DataStream.Circut(pass=setFile, state=boolean)
code_block = CodeBlock(data=setFile) { data; "do stuff"; }
await_ = Orchid.Core.DataStream.Await(pass=setFile, waitFor=code_block.data)

setFile_2 = Orchid.RevitProject.Parameters.SharedParameter.SetFile(file=circut)
watch_2 = Watch(setFile_2)
watch_3 = Watch(string)
string_2 = StringInput("%userprofile%\Documents\Modellering\Revit\Common\Shared Parameters.txt")  # graph input
fromPath = Orchid.Core.File.FromPath(path=string_2)
watch_4 = Watch(fromPath)

# group: group by group name
groupByGroupName = Orchid.RevitProject.Parameters.SharedParameter.GroupByGroupName(file=string)
watch_5 = Watch(groupByGroupName.parameter)
watch_6 = Watch(groupByGroupName.groupName)
watch_7 = Watch(groupByGroupName.type)
watch_8 = Watch(groupByGroupName.guid)

# group: group by type
groupByType = Orchid.RevitProject.Parameters.SharedParameter.GroupByType(file=string)
watch_9 = Watch(groupByType.parameter)
watch_10 = Watch(groupByType.guid)
watch_11 = Watch(groupByType.type)
watch_12 = Watch(groupByType.groupName)
