# Dynamo graph SpatialElement.dyn (Dynamo 2.0.3.8810)

categories = Categories(index=74)
getSeparationLine = Orchid.RevitProject.Elements.SpatialElement.GetSeparationLine()
watch = Watch(getSeparationLine.Element)
watch_2 = Watch(getSeparationLine.Curve)
getRoomBoundary = Orchid.RevitProject.Elements.SpatialElement.GetRoomBoundary()
watch_3 = Watch(getRoomBoundary.Curve)
watch_4 = Watch(getRoomBoundary.Element)
getSpaceBoundary = Orchid.RevitProject.Elements.SpatialElement.GetSpaceBoundary()
watch_5 = Watch(getSpaceBoundary.Element)
watch_6 = Watch(getSpaceBoundary.Curve)
getAreaBoundary = Orchid.RevitProject.Elements.SpatialElement.GetAreaBoundary()
watch_7 = Watch(getAreaBoundary.Element)
watch_8 = Watch(getAreaBoundary.Curve)
categories_2 = Categories(index=457)
all_elements_of_category = ElementsOfCategory(Category=categories_2)
getBoundary = Orchid.RevitProject.Elements.SpatialElement.GetBoundary(element=all_elements_of_category)
watch_9 = Watch(getBoundary.Element)
watch_10 = Watch(getBoundary.Curve)
getBoundary_2 = Orchid.RevitProject.Elements.SpatialElement.GetBoundary()
watch_11 = Watch(getBoundary_2.Element)
watch_12 = Watch(getBoundary_2.Curve)
getSeparationLine_2 = Orchid.RevitProject.Elements.SpatialElement.GetSeparationLine(element=all_elements_of_category)
watch_13 = Watch(getSeparationLine_2.Element)
watch_14 = Watch(getSeparationLine_2.Curve)
categories_3 = Categories(index=425)
