# Dynamo graph View-Cropbox.dyn (Dynamo 2.0.3.8810)

# group: Proces by vector
select_model_element = DSModelElementSelection()  # 1 picked in the model
getLocation = Element.GetLocation(element=select_model_element)
asVector = Point.AsVector(point=getLocation)
reverse = Vector.Reverse(vector=asVector)

# group: Adjust viewport on sheet
all = Orchid.RevitProject.Views.Viewport.All()
move = Orchid.RevitProject.Views.Viewport.Move(viewport=all, vector=reverse)  # frozen

# group: Collect all view
all_2 = Orchid.RevitProject.Views.View.All()
watch = Watch(all_2)

# group: Adjust view
modelAll = Orchid.RevitProject.Views.View.ModelAll()
move_2 = Orchid.RevitProject.Views.View.Move(view=modelAll, vector=reverse)  # frozen

# group: Adjust view crop box
modelAll_2 = Orchid.RevitProject.Views.View.ModelAll()
moveCropBox = Orchid.RevitProject.Views.View.MoveCropBox(view=modelAll_2, vector=reverse)  # frozen

# group: Adjust sectionsbox
view_type = ViewType(index=0)
byType = Orchid.RevitProject.Views.View.ByType(viewType=view_type)
moveSectionBox = Orchid.RevitProject.Views.View.MoveSectionBox(view3D=byType, vector=reverse)  # frozen

# group: Adjust view crop box
modelAll_3 = Orchid.RevitProject.Views.View.ModelAll()
getCropBox = Orchid.RevitProject.Views.View.GetCropBox(view=modelAll_3)

# group: ...by bounding box
minPoint = BoundingBox.MinPoint(boundingBox=getCropBox.BoundingBox)
add = Point.Add(point=minPoint, vectorToAdd=reverse)
maxPoint = BoundingBox.MaxPoint(boundingBox=getCropBox.BoundingBox)
add_2 = Point.Add(point=maxPoint, vectorToAdd=reverse)
byCorners = BoundingBox.ByCorners(min=add, max=add_2)
setCropBox = Orchid.RevitProject.Views.View.SetCropBox(view=modelAll_3, boundingBox=byCorners)  # frozen

# group: ...by curve
startPoint = Curve.StartPoint(curve=getCropBox.Curve)
add_3 = Point.Add(point=startPoint, vectorToAdd=reverse)
endPoint = Curve.EndPoint(curve=getCropBox.Curve)
add_4 = Point.Add(point=endPoint, vectorToAdd=reverse)
byStartPointEndPoint = Line.ByStartPointEndPoint(startPoint=add_3, endPoint=add_4)
setCropBox_2 = Orchid.RevitProject.Views.View.SetCropBox(view=modelAll_3, curve=byStartPointEndPoint)  # frozen

# group: Collect sselected view by view type
view_type_2 = ViewType(index=7)
view_type_3 = ViewType(index=15)
view_type_4 = ViewType(index=0)
list_create = List.Create(item0=view_type_2, item1=view_type_3, item2=view_type_4)
byType_2 = Orchid.RevitProject.Views.View.ByType(viewType=list_create)
watch_2 = Watch(byType_2)

# group: Model view
model_views = ModelView(index=0)
watch_3 = Watch(model_views)

# group: Sheet view
sheet_views = ModelView(index=0)
watch_4 = Watch(sheet_views)
