# Dynamo graph Sigma-ProductionUnit.dyn (Dynamo 2.1.0.6255)

# group: Element collection, grouped by Type Code
categories = Categories(index=604)  # graph input
all_elements_of_category = ElementsOfCategory(Category=categories)
code_block = CodeBlock { "Type"; sigmaTypeCode(); }
getParameterValueByName = Element.GetParameterValueByName(element=all_elements_of_category, parameterName=code_block.out0)
getParameterValueByName_2 = Element.GetParameterValueByName(element=getParameterValueByName, parameterName=code_block.out1)
groupByKey = List.GroupByKey(list=all_elements_of_category, keys=getParameterValueByName_2)
# note: coded types in selection, edit
# code block for proper sorting!
watch = Watch(groupByKey.unique_keys)
code_block_2 = CodeBlock(elem=groupByKey.groups) { sfb12 = elem[1]; sfb21 = elem[0]; }

# group: Element collection, grouped by Type Code
categories_2 = Categories(index=619)  # graph input
all_elements_of_category_2 = ElementsOfCategory(Category=categories_2)
code_block_3 = CodeBlock { "Type"; sigmaTypeCode(); }
getParameterValueByName_3 = Element.GetParameterValueByName(element=all_elements_of_category_2, parameterName=code_block_3.out0)
getParameterValueByName_4 = Element.GetParameterValueByName(element=getParameterValueByName_3, parameterName=code_block_3.out1)
groupByKey_2 = List.GroupByKey(list=all_elements_of_category_2, keys=getParameterValueByName_4)
# note: coded types in selection, edit
# code block for proper sorting!
watch_2 = Watch(groupByKey_2.unique_keys)
code_block_4 = CodeBlock(elem=groupByKey_2.groups) { sfb31 = elem[0]; }

# group: definitions for Sigma
code_block_5 = CodeBlock()
# ---------- code_block_5.designscript (14 lines) ----------
//Property identity field for Sigma
def sigmaTypeCode() {
	return = "Type Code";
};

//Components as instances or summarized
def sigmaInstances() {
	return = true;
};

//Enter estimate regulation for Sigma.
def sigmaRegulation() {
	return = 1.05;
};
# ----------------------------------------

# group: diverse Code Block input
code_block_6 = CodeBlock { sigmaTypeCode(); "pcs"; "stk"; sigmaRegulation(); sigmaInstances(); }
code_block_7 = CodeBlock { sigmaTypeCode(); "area"; "m2"; sigmaRegulation(); sigmaInstances(); }
code_block_8 = CodeBlock { sigmaTypeCode(); "length"; "lbm"; sigmaRegulation(); sigmaInstances(); }
code_block_9 = CodeBlock { sigmaTypeCode(); "volume"; "m3"; sigmaRegulation(); sigmaInstances(); }

# group: diverse Branch Root
code_block_10 = CodeBlock { "Modeled (3D)"; "Building"; "Terrain"; "Construction Site"; }
code_block_11 = CodeBlock { "Modelleret (3D)"; "Bygning"; "Terræn"; "Byggeplads"; }

# group: Element Qantifying, grouped by Tree Structure and Type Code
code_block_12 = CodeBlock(element=code_block_2.sfb12)
# ---------- code_block_12.designscript (14 lines) ----------
/*
The Component Tree structure must be kept
inside an outer list, the individual
branches in the tree are built as
a "dictionary" with a key and a value
as sublists.
*/
[
["(1.)","GROUND, SUB-STRUCTURE"],
["(12)","Foundation"]
];

// elements must be a flat 1D list
element;
# ----------------------------------------
code_block_13 = CodeBlock { sigmaTypeCode(); "length"; "lbm"; sigmaRegulation(); sigmaInstances(); }
# note: Orchid
component = Orchid.Revit.Applications.Sigma.Component(componentTree=code_block_12.out0, element=code_block_12.element, parameterName=code_block_13.out0, revitUnit=code_block_13.out1, sigmaUnit=code_block_13.out2, sigmaRegulation=code_block_13.out3)

# group: Element Qantifying, grouped by Tree Structure and Type Code
code_block_14 = CodeBlock(elemens=code_block_2.sfb21)
# ---------- code_block_14.designscript (4 lines) ----------
[["(2.)","PRIMARY ELEMENTS, CARCASS"],
["(21)","External Walls"]];

elemens;
# ----------------------------------------
code_block_15 = CodeBlock { sigmaTypeCode(); "area"; "m2"; sigmaRegulation(); sigmaInstances(); }
# note: Please note the
# default values!
# note: Orchid
component_2 = Orchid.Revit.Applications.Sigma.Component(componentTree=code_block_14.out0, element=code_block_14.elemens, parameterName=code_block_15.out0)

# group: Element Qantifying, grouped by Tree Structure and Type Code
code_block_16 = CodeBlock(elemens=code_block_4)
# ---------- code_block_16.designscript (4 lines) ----------
[["(3.)","SECONDARY ELEMENTS, COMPLETION"],
["(31)","External Walls"]];

elemens;
# ----------------------------------------
code_block_17 = CodeBlock { sigmaTypeCode(); "pcs"; "stk"; sigmaRegulation(); sigmaInstances(); }
# note: Orchid
component_3 = Orchid.Revit.Applications.Sigma.Component(componentTree=code_block_16.out0, element=code_block_16.elemens, parameterName=code_block_17.out0, revitUnit=code_block_17.out1, sigmaUnit=code_block_17.out2, sigmaRegulation=code_block_17.out3, instance=code_block_17.out4)

# group: Sigma project from file
# note: Enter path and filename for the Sigma
# project file. Project file must not be compressed!
path_and_filename = CodeBlock { cur = Orchid.Directory.Current(); cur + "\\test.sig"; }

# group: Sigma presets
# note: Enter Component Root in Sigma file,
# if DOESN'T exist, remove connection!
# Note: is cAsE sensitive!
branch_root = CodeBlock { ["","Modeled (3D)"]; }
# note: Component Root must
# exist when using clearning!
boolean = BoolSelector(true)  # graph input

# group: Sigma Revit Integration for Dynamo
join = List.Join(list0=component, list1=component_2, list2=component_3)
watch_3 = Watch(join)
document = Orchid.Generic.Applications.Sigma.Document(file=path_and_filename.out1)
# note: Orchid
setData = Orchid.Generic.Applications.Sigma.SetData(document=document, branchRoot=branch_root, clearing=boolean, component=join)
watch_4 = Watch(setData)

# group: Clean a branch
code_block_18 = CodeBlock { ["(2.)","PRIMARY ELEMENTS, CARCASS"]; }
clearing = Orchid.Generic.Applications.Sigma.Clearing(branch=code_block_18)  # frozen
watch_5 = Watch(clearing)

# group: Delete a branch
code_block_19 = CodeBlock { ["(2.)","PRIMARY ELEMENTS, CARCASS"]; }
delete = Orchid.Generic.Applications.Sigma.Delete(branch=code_block_19)  # frozen
watch_6 = Watch(delete)

# group: Sigma project from template
path_and_filename_2 = StringInput("%userprofile%\Documents\Sigma Enterprise\Templates\DanEDU\Estimate (DanEDU).sit")  # graph input
fromPath = Orchid.Generic.Core.File.FromPath(path=path_and_filename_2)
