# Dynamo graph CompoundLayer.dyn (Dynamo 2.0.1.5055)

categories = Categories(index=604)  # graph input
all_elements_of_category = ElementsOfCategory(Category=categories)
elementType = Element.ElementType(element=all_elements_of_category)
uniqueItems = List.UniqueItems(list=elementType)
code_block = CodeBlock { ["MyMat1","MyMat2"]; ["Glass","Copper"]; }
byName = Material.ByName(name=code_block.out1)
code_block_2 = CodeBlock { [0,1]; }
setCompoundLayerMaterial = Orchid.Revit.Elements.SystemFamily.SetCompoundLayerMaterial(elementType=uniqueItems, material=byName, index=code_block_2)
watch = Watch(setCompoundLayerMaterial)
wall_types = WallTypes(index=0)  # graph input
code_block_3 = CodeBlock { "Glass"; }
byName_2 = Material.ByName(name=code_block_3)
code_block_4 = CodeBlock()
# ---------- code_block_4.designscript (10 lines) ----------
//function
5;
//thickness
100;
//wrap as boolean
false;
//placement
"Interior";
//index
3;
# ----------------------------------------
createCompoundLayer = Orchid.Revit.Elements.SystemFamily.CreateCompoundLayer(elementType=wall_types, material=byName_2, thickness=code_block_4.out1, index=code_block_4.out4)  # frozen
wall_types_2 = WallTypes(index=0)  # graph input
code_block_5 = CodeBlock { 3; }
deleteCompoundLayer = Orchid.Revit.Elements.SystemFamily.DeleteCompoundLayer(elementType=wall_types_2, index=code_block_5)  # frozen
wall_types_3 = WallTypes(index=0)  # graph input
code_block_6 = CodeBlock { "Glass"; }
byName_3 = Material.ByName(name=code_block_6)
code_block_7 = CodeBlock { 1; }
setCompoundLayerMaterial_2 = Orchid.Revit.Elements.SystemFamily.SetCompoundLayerMaterial(elementType=wall_types_3, material=byName_3, index=code_block_7)  # frozen
wall_types_4 = WallTypes(index=0)  # graph input
code_block_8 = CodeBlock { 300.0; 1; }
setCompoundLayerWidth = Orchid.Revit.Elements.SystemFamily.SetCompoundLayerWidth(elementType=wall_types_4, thickness=code_block_8.out0, index=code_block_8.out1)  # frozen
wall_types_5 = WallTypes(index=0)  # graph input
compound_layer_function = LayerFunctionDD(index=4)  # graph input
code_block_9 = CodeBlock { "Glass"; }
byName_4 = Material.ByName(name=code_block_9)
code_block_10 = CodeBlock()
# ---------- code_block_10.designscript (6 lines) ----------
//thickness
100;
//wrap as boolean
false;
//index
3;
# ----------------------------------------
compound_layer_placement = LayerPlacementDD(index=2)  # graph input
createCompoundLayer_2 = Orchid.Revit.Elements.SystemFamily.CreateCompoundLayer(elementType=wall_types_5, function=compound_layer_function, material=byName_4, thickness=code_block_10.out0, placement=compound_layer_placement, index=code_block_10.out2)  # frozen
