# Dynamo graph Print.dyn (Dynamo 2.0.2.6826)

code_block = CodeBlock()
# ---------- code_block.designscript (7 lines) ----------
"Adobe PDF";
"Microsoft Print to PDF";
"Microsoft XPS Document Writer";

//Hidden built-in printer
//not supported at the moment!
"Revit DWF Exporter";
# ----------------------------------------
string = StringInput("Default")  # graph input
code_block_2 = CodeBlock { 100; }
printer = PrinterDD(index=2)  # graph input
string_2 = StringInput("testSetting")  # graph input
print_papersizes = PrintPaperSizesDD(index=7)  # graph input
print_pageorientation = PrintPageOrientationDD(index=1)  # graph input
print_margintype = PrintMarginTypeDD(index=2)  # graph input
code_block_3 = CodeBlock { [10,10]; }
changeSetting = Orchid.Revit.Core.Print.ChangeSetting(printer=printer, printSetting=string_2, paperZize=print_papersizes, pageOrientation=print_pageorientation, marginType=print_margintype, margin=code_block_3)  # frozen
printer_2 = PrinterDD(index=2)  # graph input
view_sheet_set = ViewSheetSetDD(index=0)  # graph input
getView = Orchid.Revit.Core.ViewSheetSet.GetView(viewSheetSet=view_sheet_set)

# group: filePath --> file name incl. path
current = Orchid.Generic.Core.Directory.Current()
string_3 = StringInput("testSet")  # graph input
sheetNumber = Sheet.SheetNumber(sheet=getView)
code_block_4 = CodeBlock(a=current, b=string_3, c=sheetNumber)
# ---------- code_block_4.designscript (3 lines) ----------
a + "\\" +
b + "\\" +
c;
# ----------------------------------------

# note: Print Setting may be set
# both as an element and
# as a string
print_setting = PrintSettingDD(index=0)  # graph input
byViewSheetSet = Orchid.Revit.Core.Print.ByViewSheetSet(printer=printer_2, filePath=code_block_4, viewSheetSet=view_sheet_set, printSetting=print_setting)  # frozen
boolean = BoolSelector(true)  # graph input
boolean_2 = BoolSelector(true)  # graph input
byView = Orchid.Revit.Core.Print.ByView(printer=printer_2, combine=boolean, file=boolean_2, filePath=code_block_4, view=getView, printSetting=print_setting)  # frozen
# note: Set to "Select" to print the selected views
print_range = PrintRangeDD(index=1)  # graph input

# group: Remove print setting
print_setting_2 = PrintSettingDD(index=0)  # graph input
# note: Print Setting may be set
# both as an element and
# as a string
string_4 = StringInput("testSetting")  # graph input
deleteSetting = Orchid.Revit.Core.Print.DeleteSetting(printSetting=string_4)  # frozen

print_zoomtype = PrintZoomTypeDD(index=1)  # graph input
print_paperplacement = PrintPaperPlacementDD(index=1)  # graph input
createSetting = Orchid.Revit.Core.Print.CreateSetting(printer=printer, name=string_2)  # frozen

# group: Print current view (center and fit to page)
printer_3 = PrinterDD(index=2)  # graph input
string_5 = StringInput("testSetting")  # graph input
print_papersizes_2 = PrintPaperSizesDD(index=8)  # graph input
print_paperplacement_2 = PrintPaperPlacementDD(index=0)  # graph input
print_zoomtype_2 = PrintZoomTypeDD(index=0)  # graph input
createSetting_2 = Orchid.Revit.Core.Print.CreateSetting(printer=printer_3, name=string_5, paperZize=print_papersizes_2, paperPlacement=print_paperplacement_2, zoomType=print_zoomtype_2)
print_range_2 = PrintRangeDD(index=0)  # graph input
activeView = Orchid.Revit.Core.Document.ActiveView()
byView_2 = Orchid.Revit.Core.Print.ByView(printer=printer_3, printRange=print_range_2, view=activeView, printSetting=createSetting_2)
# note: if print options there are rarely set need to be included, then connect:
# "Print.SetOptions" output Printsetting to "Print.ByView" input printSetting!
await_ = Orchid.Generic.Core.DataStream.Await(pass=createSetting_2, waitFor=byView_2)
deleteSetting_2 = Orchid.Revit.Core.Print.DeleteSetting(printSetting=await_)

# group: ViewSheetSet
categories = Categories(index=447)  # graph input; frozen
all_elements_of_category = ElementsOfCategory(Category=categories)
string_6 = StringInput("testSet")  # graph input
create = Orchid.Revit.Core.ViewSheetSet.Create(view=all_elements_of_category, name=string_6)
getView_2 = Orchid.Revit.Core.ViewSheetSet.GetView(viewSheetSet=create)
view_sheet_set_2 = ViewSheetSetDD(index=0)  # graph input
change = Orchid.Revit.Core.ViewSheetSet.Change(view=getView_2, viewSheetSet=view_sheet_set_2)
delete = Orchid.Revit.Core.ViewSheetSet.Delete(viewSheetSet=create)

# group: Print options there are rarely set
boolean_3 = BoolSelector(true)  # graph input
boolean_4 = BoolSelector(false)  # graph input
print_hiddenlineviews = HiddenLineViewsTypeDD(index=1)  # graph input
print_rasterquality = RasterQualityTypeDD(index=2)  # graph input
print_colordepth = ColorDepthTypeDD(index=2)  # graph input
setOptions = Orchid.Revit.Core.Print.SetOptions(printSetting=createSetting_2, viewLinksinBlue=boolean_3, hideReforWorkPlanes=boolean_4, hideUnreferencedViewTags=boolean_3, maskCoincidentLines=boolean_3, hideScopeBoxes=boolean_4, hideCropBoundaries=boolean_4, replaceHalftoneWithThinLines=boolean_3, hiddenLineViews=print_hiddenlineviews, rasterQuality=print_rasterquality, colorDepth=print_colordepth)  # frozen
