# Dynamo graph Material.dyn (Dynamo 2.0.2.6826)

# group: Create, Set Render Appearance, SetShadingColor, Set Transparency, Set Surface Pattern, Set Surface Pattern Color, Set Cut Pattern, Set Cut Pattern Color
code_block = CodeBlock { "_test1"; }
create = Orchid.Revit.Materials.Material.Create(name=code_block)
boolean = BoolSelector(false)  # graph input
setRenderAppearance = Orchid.Revit.Materials.Graphics.SetRenderAppearance(material=create, useRenderAppearance=boolean)
code_block_2 = CodeBlock { [25,60,30,0]; }
setShadingColor = Orchid.Revit.Materials.Graphics.SetShadingColor(material=setRenderAppearance, color=code_block_2)
code_block_3 = CodeBlock { 75; }
setTransparency = Orchid.Revit.Materials.Graphics.SetTransparency(material=setShadingColor, transparency=code_block_3)
fill_patterns = FillPatterns(index=1)  # graph input
setSurfacePattern = Orchid.Revit.Materials.Graphics.SetSurfacePattern(material=setTransparency, pattern=fill_patterns)
code_block_4 = CodeBlock { 145; 185; 165; }
byARGB = Color.ByARGB(r=code_block_4.out0, g=code_block_4.out1, b=code_block_4.out2)
setSurfacePatternColor = Orchid.Revit.Materials.Graphics.SetSurfacePatternColor(material=setSurfacePattern, color=byARGB)
setCutPattern = Orchid.Revit.Materials.Graphics.SetCutPattern(material=setSurfacePatternColor, pattern=fill_patterns)
watch = Watch(setCutPattern)
name = Material.Name(material=setCutPattern)
watch_2 = Watch(name)
getShadingColor = Orchid.Revit.Materials.Graphics.GetShadingColor(material=setShadingColor)
watch_3 = Watch(getShadingColor)
getTransparency = Orchid.Revit.Materials.Graphics.GetTransparency(material=setTransparency)
watch_4 = Watch(getTransparency)
getSurfacePattern = Orchid.Revit.Materials.Graphics.GetSurfacePattern(material=setSurfacePattern)
watch_5 = Watch(getSurfacePattern)
getCutPattern = Orchid.Revit.Materials.Graphics.GetCutPattern(material=setCutPattern)
watch_6 = Watch(getCutPattern)
setCutPatternColor = Orchid.Revit.Materials.Graphics.SetCutPatternColor(material=setCutPattern, color=byARGB)
getCutPatternColor = Orchid.Revit.Materials.Graphics.GetCutPatternColor(material=setCutPatternColor)
watch_7 = Watch(getCutPatternColor)
getSurfacePatternColor = Orchid.Revit.Materials.Graphics.GetSurfacePatternColor(material=setSurfacePatternColor)
watch_8 = Watch(getSurfacePatternColor)
getRenderAppearance = Orchid.Revit.Materials.Graphics.GetRenderAppearance(material=setRenderAppearance)
watch_9 = Watch(getRenderAppearance)

# group: Create, Get
code_block_5 = CodeBlock { "_test2"; }
create_2 = Orchid.Revit.Materials.Material.Create(name=code_block_5)
watch_10 = Watch(create_2)
boolean_2 = BoolSelector(false)  # graph input
code_block_6 = CodeBlock { [25,60,30,0]; 50; }
fill_patterns_2 = FillPatterns(index=5)  # graph input
code_block_7 = CodeBlock { 45; 85; 65; }
byARGB_2 = Color.ByARGB(r=code_block_7.out0, g=code_block_7.out1, b=code_block_7.out2)
set = Orchid.Revit.Materials.Graphics.Set(material=create_2, useRenderAppearance=boolean_2, shadingColor=code_block_6.out0, transparency=code_block_6.out1, surfacePattern=fill_patterns_2, surfacePatternColor=byARGB_2)
get = Orchid.Revit.Materials.Graphics.Get(material=set)
watch_11 = Watch(get.UseRenderAppearance)
watch_12 = Watch(get.ShadingColor)
watch_13 = Watch(get.Transparency)
watch_14 = Watch(get.SurfacePattern)
watch_15 = Watch(get.SurfacePatternColor)
watch_16 = Watch(get.CutPattern)
name_2 = Material.Name(material=create_2)
watch_17 = Watch(name_2)
watch_18 = Watch(get.CutPatternColor)

# group: All
all = Orchid.Revit.Materials.Material.All()
name_3 = Material.Name(material=all)
watch_19 = Watch(name_3)
watch_20 = Watch(all)

# group: Class/Category
material = MaterialDD(index=1)  # graph input
getCategory = Orchid.Revit.Materials.Material.GetCategory(material=material)
watch_21 = Watch(getCategory)
getClass = Orchid.Revit.Materials.Material.GetClass(material=material)
watch_22 = Watch(getClass)

# group: Asset
material_2 = MaterialDD(index=1)  # graph input
asset = Orchid.Revit.Materials.Material.Asset(material=material_2)
watch_23 = Watch(asset.Appearance)
watch_24 = Watch(asset.Physical)
watch_25 = Watch(asset.Thermal)

# group: Smoothness, Shininess
code_block_8 = CodeBlock { "_test3"; }
create_3 = Orchid.Revit.Materials.Material.Create(name=code_block_8)
code_block_9 = CodeBlock { 50; }
setSmoothness = Orchid.Revit.Materials.Graphics.SetSmoothness(material=create_3, smoothness=code_block_9)
getSmoothness = Orchid.Revit.Materials.Graphics.GetSmoothness(material=setSmoothness)
watch_26 = Watch(getSmoothness)
setShininess = Orchid.Revit.Materials.Graphics.SetShininess(material=create_3, shininess=code_block_9)
getShininess = Orchid.Revit.Materials.Graphics.GetShininess(material=setShininess)
watch_27 = Watch(getShininess)

# group: Asset Parameter
material_3 = MaterialDD(index=1)  # graph input
assetParameter = Orchid.Revit.Materials.Material.AssetParameter(material=material_3)
watch_28 = Watch(assetParameter.Appearance)
watch_29 = Watch(assetParameter.Physical)
watch_30 = Watch(assetParameter.Thermal)

# group: Parameter
material_4 = MaterialDD(index=1)  # graph input
parameter = Orchid.Revit.Materials.Material.Parameter(material=material_4)
watch_31 = Watch(parameter)
